# Grasshopper definition RoboticAssemblyPrototype.gh (Grasshopper 1.0.8)
# plug-ins: Aggregations, RhinoCodePluginGH, Pufferfish, Human, MetaHopper, Kangaroo2 Components, Palette, Telepathy, Flexibility

# ---- group: other_
out = ColourSwatch(SwatchColor=RGB(110, 245, 234))
b = ColourSwatch(SwatchColor=RGB(196, 196, 196))
in = ColourSwatch(SwatchColor=RGB(121, 219, 112))
ctrl = ColourSwatch(SwatchColor=RGB(209, 237, 85))
viz = ColourSwatch(SwatchColor=RGB(218, 192, 240))
other = ColourSwatch(SwatchColor=RGB(255, 255, 255))
calc = ColourSwatch(SwatchColor=RGB(196, 157, 157))
connected = GetConnectedObjects(Objects=[in, b, out, ctrl, calc, viz, other])
object_info = ObjectInfo(Objects=connected)  # -> Name, NickName, Type, Pivot, Bounds, Value, Enabled, Preview
concat = Concatenate(FragmentA=object_info.NickName, FragmentB="*")
groups = GetGroups()  # -> Groups, GroupStyles, Nickname, Color
graft = GraftTree(Tree=concat, IncludeEmptyLists=True, IncludeNullItems=True)
tmatch = MatchText(Text=groups.Nickname, Pattern=graft, Case=True)
cull = CullPattern(List=groups.Groups, CullPattern=tmatch)
tstat = TreeStatistics(Tree=cull)  # -> Paths, Length, Count
equals = Equality(FirstNumber=tstat.Length, SecondNumber=0)  # -> Equality, Inequality
cull_2 = CullPattern(List=object_info.Value, CullPattern=equals.Inequality)
prune = PruneTree(Tree=cull, Minimum="1", Maximum=0)
graft_2 = GraftTree(Tree=cull_2, IncludeEmptyLists=True, IncludeNullItems=True)
setgroup = SetGroupProperties(Group=simplify(prune), Color=simplify(graft_2))

# ----
panel = Panel("""absl-py==2.1.0
asttokens==2.4.1
astunparse==1.6.3
attrs==24.2.0
cachetools==5.5.0
certifi==2024.8.30
charset-normalizer==3.3.2
click-plugins==1.1.1
click==8.1.7
cligj==0.7.2
colorama==0.4.6
comm==0.2.2
contourpy==1.3.0
cycler==0.12.1
decorator==5.1.1
dm-tree==0.1.8
docstring-parser==0.16
etils==1.9.4
exceptiongroup==1.2.2
executing==2.1.0
filelock==3.16.0
fiona==1.10.1
flatbuffers==24.3.25
fonttools==4.53.1
fsspec==2024.9.0
gast==0.4.0
geographiclib==2.0
geopandas==1.0.1
geopy==2.4.1
ghhops-server==1.5.5
google-auth-oauthlib==0.4.6
google-auth==2.34.0
google-pasta==0.2.0
grpcio==1.66.1
h5py==3.11.0
idna==3.8
immutabledict==4.2.0
importlib-resources==6.4.5
iopath==0.1.10
ipympl==0.9.4
ipython-genutils==0.2.0
ipython==8.27.0
ipywidgets==8.1.5
jedi==0.19.1
jinja2==3.1.4
jupyterlab-widgets==3.0.13
keras-preprocessing==1.1.2
keras==2.10.0
kiwisolver==1.4.7
libclang==18.1.1
lxml==5.3.0
markdown-it-py==3.0.0
markdown==3.7
markupsafe==2.1.5
matplotlib-inline==0.1.7
matplotlib==3.9.2
mdurl==0.1.2
ml-dtypes==0.4.0
mpmath==1.3.0
namex==0.0.8
networkx==3.2.1
numpy==2.0.2
oauthlib==3.2.2
openexr==3.2.4
opt-einsum==3.3.0
optree==0.12.1
owslib==0.31.0
packaging==24.1
pandas==2.2.2
parso==0.8.4
pillow==10.4.0
pip==24.2
portalocker==2.10.1
promise==2.3
prompt-toolkit==3.0.47
protobuf==3.19.6
psutil==6.0.0
pure-eval==0.2.3
pyarrow==17.0.0
pyasn1-modules==0.4.0
pyasn1==0.6.0
pydot==3.0.1
pygame==2.6.1
pygments==2.18.0
pygraphviz==1.14rc0.dev0
pyogrio==0.10.0
pyopengl-accelerate==3.1.7
pyopengl==3.1.7
pyparsing==3.1.4
pyproj==3.7.0
pyqt5-qt5==5.15.2
pyqt5-sip==12.15.0
pyqt5==5.15.11
pyqtgraph==0.13.7
python-dateutil==2.9.0.post0
pytz==2024.1
pywin32==306
pyyaml==6.0.2
requests-oauthlib==2.0.0
requests==2.32.3
rhino3dm==8.9.0
rich==13.8.0
robodk==5.7.5
rsa==4.9
scipy==1.14.1
setuptools==65.5.0
shapely==2.0.6
simple-parsing==0.1.6
six==1.16.0
stack-data==0.6.3
sympy==1.13.2
tensorboard-data-server==0.6.1
tensorboard-plugin-wit==1.8.1
tensorboard==2.10.1
tensorflow-addons==0.22.0
tensorflow-datasets==4.9.6
tensorflow-estimator==2.10.0
tensorflow-gpu==2.10.1
tensorflow-graphics==2021.12.3
tensorflow-io-gcs-filesystem==0.31.0
tensorflow-metadata==1.15.0
termcolor==2.4.0
toml==0.10.2
torch==2.0.1+cu117
torchaudio==2.0.2+cu117
torchvision==0.15.2+cu117
tqdm==4.66.5
traitlets==5.14.3
trimesh==4.4.9
typeguard==2.13.3
typing-extensions==4.12.2
tzdata==2024.1
urllib3==2.2.2
visual-kinematics==0.2.1
vtk==9.3.1
wcwidth==0.2.13
werkzeug==3.0.4
wheel==0.44.0
widgetsnbextension==4.0.13
wrapt==1.16.0
zipp==3.20.1""")
palette = Palette(
    ModeCustomStandard=Toggle(True),
    Component_Normal_Deselected_Fill_Color=RGB(148, 148, 148),
    Component_Normal_Deselected_Edge_Color=RGB(0, 0, 0),
    Component_Normal_Deselected_Text_Color=RGB(0, 0, 0),
    Component_Normal_Selected_Fill_Color=RGB(149, 199, 101),
    Component_Normal_Selected_Edge_Color=RGB(255, 0, 0),
    Component_Normal_Selected_Text_Color=RGB(0, 25, 0),
    Component_Hidden_Deselected_Fill_Color=RGB(138, 138, 153),
    Component_Hidden_Deselected_Edge_Color=RGB(0, 0, 0),
    Component_Hidden_Deselected_Text_Color=RGB(0, 0, 0),
    Component_Hidden_Selected_Fill_Color=RGB(182, 227, 150),
    Component_Hidden_Selected_Edge_Color=RGB(0, 35, 0),
    Component_Hidden_Selected_Text_Color=RGB(0, 25, 0),
    Component_Disabled_Deselected_Fill_Color=RGB(204, 0, 0),
    Component_Disabled_Deselected_Edge_Color=RGB(0, 0, 0),
    Component_Disabled_Deselected_Text_Color=RGB(0, 0, 0),
    Component_Disabled_Selected_Fill_Color=RGB(212, 131, 131),
    Component_Disabled_Selected_Edge_Color=RGB(0, 0, 0),
    Component_Disabled_Selected_Text_Color=RGB(0, 0, 0),
    Component_Warning_Deselected_Fill_Color=RGB(255, 132, 0),
    Component_Warning_Deselected_Edge_Color=RGB(80, 10, 0),
    Component_Warning_Deselected_Text_Color=RGB(0, 0, 0),
    Component_Warning_Selected_Fill_Color=RGB(185, 205, 0),
    Component_Warning_Selected_Edge_Color=RGB(0, 50, 0),
    Component_Warning_Selected_Text_Color=RGB(0, 0, 0),
    Component_Error_Deselected_Fill_Color=RGB(200, 0, 0),
    Component_Error_Deselected_Edge_Color=RGB(60, 0, 0),
    Component_Error_Deselected_Text_Color=RGB(0, 0, 0),
    Component_Error_Selected_Fill_Color=RGB(125, 155, 0),
    Component_Error_Selected_Edge_Color=RGB(0, 50, 0),
    Component_Error_Selected_Text_Color=RGB(255, 255, 255),
    Component_Label_Deselected_Fill_Color=RGB(50, 50, 50),
    Component_Label_Deselected_Edge_Color=RGB(0, 0, 0),
    Component_Label_Deselected_Text_Color=RGB(255, 255, 255),
    Component_Label_Selected_Fill_Color=RGB(25, 60, 25),
    Component_Label_Selected_Edge_Color=RGB(0, 35, 0),
    Component_Label_Selected_Text_Color=RGB(190, 250, 180),
    Galapagos_Deselected_Fill_Color=RGB(255, 0, 125),
    Galapagos_Deselected_Edge_Color=RGB(100, 0, 50),
    Galapagos_Selected_Fill_Color=RGB(160, 210, 30),
    Galapagos_Selected_Edge_Color=RGB(0, 50, 0),
    Wire_Normal_Color=RGBA(0, 0, 0, 150),
    Wire_Empty_Color=RGBA(255, 60, 0, 180),
    Wire_Selected_Start_Color=RGB(125, 210, 40),
    Wire_Selected_End_Color=RGBA(0, 0, 0, 50),
    Panel_Default_Color=RGB(255, 250, 90),
    Group_Default_Color=RGBA(255, 255, 255, 150),
    Canvas_Background_Color=RGB(224, 224, 224),
    Canvas_Gridline_Color=RGBA(0, 0, 0, 30),
    Canvas_Gridline_Width=150,
    Canvas_Gridline_Height=50,
    Canvas_Edge_Color=RGB(255, 255, 255),
    Canvas_Shadow_Color=RGBA(0, 0, 0, 80),
    Canvas_Shadow_Size=30,
    MonochromaticOnOff=False,
    Monochromatic_Color=RGB(212, 208, 200))

# ---- group: in_Structure
pt = Point(<point referenced from the Rhino model>)
crv = Curve([<curve referenced from the Rhino model> x13])
pt_2 = Point([<point referenced from the Rhino model> x3])

# ---- group: in_RobotID
# ROBOT BASE SYNC
# 
# The physical calibration is processed using the normalized distance of the table grid of the UR5. After selecting 1)the desired points, the XYZ location of the Robot Base and 2)the rotation of the base around the Z-axis, the data gets parsed in the RoboDK environment. Through ID manipulation, you can search for matching IDs
# in the RoboDK environment and syncronize with Rhinoceros workspace.
panel_2 = Panel("""UR5 A
COMAU""")
list = ValueList({"UR5 A": 0, "UR5 B": 1, "COMAU": 2, "COWORKING": 3}, selected="UR5 A")
list_2 = ValueList({"UR5 A": 0, "UR5 B": 1, "COMAU": 2, "COWORKING": 3}, selected="UR5 B")
list_3 = ValueList({"UR5 A": 0, "UR5 B": 1, "COMAU": 2, "COWORKING": 3}, selected="COMAU")
filter = StreamFilter(Gate=list, Stream0="UR5 A", Stream1="UR5 B", Stream2="COMAU", Stream3=panel_2)
filter_2 = StreamFilter(Gate=list_2, Stream0="UR5 A", Stream1="UR5 B", Stream2="COMAU", Stream3=panel_2)
filter_3 = StreamFilter(Gate=list_3, Stream0="UR5 A", Stream1="UR5 B", Stream2="COMAU", Stream3=panel_2)
robot_1 = RemoteSender(filter)
robot_2 = RemoteSender(filter_2)
robot_3 = RemoteSender(filter_3)

# ---- group: calc_AssemblySequence
py3_trussemble = Python3Script(in_lines=crv, in_rigid_points=pt_2, in_start_point=pt)  # -> out, assembly_steps, ordered_nodes, line_indices; inputs in_lines: list of Line, in_rigid_points: list of Point3d, in_start_point: Point3d
# ---------- py3_trussemble: Python ----------
import rhinoscriptsyntax as rs
import Grasshopper as gh
import Grasshopper.Kernel as ghk
from Grasshopper.Kernel.Data import GH_Path
import Rhino.Geometry as rg
import networkx as nx
from collections import Counter
import math
import numpy as np
import itertools
from itertools import combinations

class Trussemble:
    def __init__(self, lines, rigid_points, start_point):
        ## inputs
        self.lines = lines
        self.points, self.connection_tree = self.__get_line_connectivity()
        self.rigid_points = rigid_points
        self.rigid_indices = self.__get_rigid_point_indices()
        self.start_point = start_point
        ## outputs
        self.edge_list = None
        self.graph = self.__turn_tree_to_graph(self.connection_tree)
        self.assembly_steps = gh.DataTree[object]()
        self.assembly_step_line_indices = gh.DataTree[object]()
        self.processed_nodes = []

    def __average_point(self, pt1, pt2, pt3):
        avg_x = (pt1.X + pt2.X + pt3.X) / 3
        avg_y = (pt1.Y + pt2.Y + pt3.Y) / 3
        avg_z = (pt1.Z + pt2.Z + pt3.Z) / 3
        return rg.Point3d(avg_x, avg_y, avg_z)

    def __get_rigid_point_indices(self):
        rigid_indices = []
        points_array = np.array([[pt.X, pt.Y, pt.Z] for pt in self.points])

        for rigid_point in self.rigid_points:
            if rigid_point in self.points:
                rigid_indices.append(self.points.index(rigid_point))
            else:
                rigid_point_array = np.array([rigid_point.X, rigid_point.Y, rigid_point.Z])
                distances = np.linalg.norm(points_array - rigid_point_array, axis=1)
                rigid_idx = np.argmin(distances)
                rigid_indices.append(rigid_idx)
        return rigid_indices

    def __get_line_connectivity(self):
        lines = self.lines
        connectivity_tree = gh.DataTree[object]()
        unique_points = {}

        for line_index, line in enumerate(lines):
            # Convert GH_Curve to Rhino.Geometry.Curve if necessary
            if hasattr(line, "Value"):
                line = line.Value

            # Get the start and end points of the line if it's a Line or a linear Curve
            if isinstance(line, rg.Line):
                start_point = line.From
                end_point = line.To
            elif isinstance(line, rg.Curve) and line.IsLinear():
                start_point = line.PointAtStart
                end_point = line.PointAtEnd
            else:
                raise ValueError("Line input must be of type Line or linear Curve")

            # Ensure that points are rounded to avoid floating point issues
            start_point3d = rg.Point3d(round(start_point.X, 3), round(start_point.Y, 3), round(start_point.Z, 3))
            end_point3d = rg.Point3d(round(end_point.X, 3), round(end_point.Y, 3), round(end_point.Z, 3))

            if start_point3d not in unique_points:
                unique_points[start_point3d] = len(unique_points)
            if end_point3d not in unique_points:
                unique_points[end_point3d] = len(unique_points)

            start_index = unique_points[start_point3d]
            end_index = unique_points[end_point3d]

            connectivity_tree.EnsurePath(GH_Path(line_index))
            connectivity_tree.AddRange([start_index, end_index], GH_Path(line_index))

        unique_points_list = list(unique_points.keys())
        return unique_points_list, connectivity_tree

    def __can_node_be_rigid(self, node):
        if node in self.rigid_indices:
            return True
        else:
            neighbours = list(self.graph.neighbors(node))
            count_existing_neighbours = sum(1 for neighbour in neighbours if neighbour in self.processed_nodes)
            return count_existing_neighbours >= 3

    def __turn_tree_to_graph(self, connections_tree):
        list_of_tuples = []
        for i in range(connections_tree.BranchCount):
            branch = connections_tree.Branch(i)
            if len(branch) == 2:
                list_of_tuples.append(tuple(branch))
        self.edge_list = list_of_tuples
        G = nx.Graph()
        G.add_edges_from(list_of_tuples)
        return G

    def __get_first_move(self):
        start_point = self.start_point
        rigid_ids = self.rigid_indices
        points = self.points
        graph = self.graph

        min_avg_distance_to_start = float('inf')
        neighbours_to_connect_to = []
        first_supports = None

        def find_common_neighbour_combinations(graph, rigid_points_indices):
            valid_combinations = []
            common_neighbors = []
            for comb in combinations(rigid_points_indices, 3):
                neighbors_1 = set(graph.neighbors(comb[0]))
                neighbors_2 = set(graph.neighbors(comb[1]))
                neighbors_3 = set(graph.neighbors(comb[2]))
                common_neighbor = neighbors_1 & neighbors_2 & neighbors_3
                if common_neighbor:
                    valid_combinations.append(comb)
                    common_neighbors.append(list(common_neighbor)[0])
            return valid_combinations, common_neighbors

        starting_three_candidates, common_neighbours = find_common_neighbour_combinations(graph, rigid_ids)

        for i, starting_three in enumerate(starting_three_candidates):
            p1 = points[starting_three[0]]
            p2 = points[starting_three[1]]
            p3 = points[starting_three[2]]
            centre = self.__average_point(p1, p2, p3)
            avg_distance = rs.Distance(start_point, centre)
            if avg_distance < min_avg_distance_to_start:
                min_avg_distance_to_start = avg_distance
                first_supports = starting_three
                neighbours_to_connect_to.append(list([common_neighbours[i]]))

        neighbour_to_connect_to = neighbours_to_connect_to[-1][0]
        self.processed_nodes.extend(first_supports)
        self.processed_nodes.append(neighbour_to_connect_to)
        return list(first_supports), neighbour_to_connect_to

    def __check_missing_edges(self, sub_graph_edges):
        edges_to_add = []
        for node1, node2 in combinations(sub_graph_edges, 2):
            if self.graph.has_edge(node1, node2):
                edges_to_add.append((node1, node2))
        return edges_to_add

    def __find_unprocessed_neighbors_subgraphs(self):
        graph = self.graph
        processed_nodes = self.processed_nodes
        processed_nodes_set = set(processed_nodes)
        points = self.points

        unprocessed_neighbors = set()
        last_node = processed_nodes[-1]
        neighbors_last_node = set(graph.neighbors(last_node))
        unprocessed_neighbors_last_node = neighbors_last_node - processed_nodes_set

        for node in processed_nodes_set:
            if node == last_node:
                continue
            neighbors = set(graph.neighbors(node))
            unprocessed_neighbors.update(neighbors - processed_nodes_set)

        unprocessed_neighbors.update(unprocessed_neighbors_last_node)

        subgraphs = []
        unprocessed_subgraph = graph.subgraph(unprocessed_neighbors)

        for component in nx.connected_components(unprocessed_subgraph):
            subgraphs.append(list(component))

        subgraphs_sorted = []
        subgraph_last_node = [comp for comp in subgraphs if any(node in unprocessed_neighbors_last_node for node in comp)]
        other_subgraphs = [comp for comp in subgraphs if comp not in subgraph_last_node]

        if subgraph_last_node:
            subgraphs_sorted.extend(subgraph_last_node)
            subgraphs_sorted.extend(other_subgraphs)
            return subgraphs_sorted[0]
        else:
            closest_distance = float('inf')
            first_comp = None
            for comp in subgraphs:
                for node in comp:
                    distance = (points[last_node] - points[node]).Length
                    if distance < closest_distance:
                        first_comp = comp
                        closest_distance = distance
            return first_comp

    def __get_possible_connections(self, node):
        return [neighbour for neighbour in self.graph.neighbors(node) if neighbour in self.processed_nodes]

    def __sort_rigid_candidates(self, candidates):
        origin = self.processed_nodes[-1]
        points = self.points

        def distance_to_origin(c):
            return (points[origin] - points[c]).Length

        return sorted(candidates, key=distance_to_origin)

    def __get_sorted_supports(self, candidate, supports):
        support_combinations = list(itertools.combinations([x for x in range(len(supports))], 3))
        score_per_combination = {}
        result_supports = []

        def get_combined_distance_to_supports(supports):
            support_coords = np.array([[pt.X, pt.Y, pt.Z] for pt in supports])
            num_supports = len(support_coords)
            diff = support_coords[:, np.newaxis, :] - support_coords[np.newaxis, :, :]
            distances = np.linalg.norm(diff, axis=2)
            distances += np.eye(num_supports) * 1e-8
            combined_distance = np.prod(distances)
            return combined_distance

        def triangle_area(rs_pointA, rs_pointB, rs_pointC):
            A = np.array([rs_pointA.X, rs_pointA.Y, rs_pointA.Z])
            B = np.array([rs_pointB.X, rs_pointB.Y, rs_pointB.Z])
            C = np.array([rs_pointC.X, rs_pointC.Y, rs_pointC.Z])
            area = 0.5 * np.linalg.norm(np.cross(B - A, C - A))
            return area

        for c in support_combinations:
            supports_list = [supports[c[0]], supports[c[1]], supports[c[2]]]
            combined_distance = float(get_combined_distance_to_supports(supports_list))
            area = float(triangle_area(supports_list[0], supports_list[1], supports_list[2]))
            score = combined_distance if area == 0.0 else combined_distance / area
            score_per_combination[c] = score

        score_per_combination = dict(sorted(score_per_combination.items(), key=lambda item: item[1]))
        support_combinations = list(score_per_combination.keys())
        for support_combination in support_combinations:
            result_support = list(support_combination)
            for i, support in enumerate(supports):
                if i not in support_combination:
                    result_support.append(i)
                result_supports.append(result_support)

        return result_supports[0]

    def __check_if_door(self, support_nodes, load_node):
        support_points = [self.points[x] for x in support_nodes]
        load_point = self.points[load_node]
        combination = []

        def point_plane_distance(plane_pts, test_pt):
            A, B, C = plane_pts
            AB = B - A
            AC = C - A
            normal_vector = rg.Vector3d.CrossProduct(AB, AC)
            if normal_vector.IsZero:
                return 0.0
            normal_vector.Unitize()
            D = -(normal_vector.X * A.X + normal_vector.Y * A.Y + normal_vector.Z * A.Z)
            numerator = abs(normal_vector.X * test_pt.X + normal_vector.Y * test_pt.Y + normal_vector.Z * test_pt.Z + D)
            return numerator

        def distance_to_centroid(pts, test_pt):
            centroid = rg.Point3d((pts[0].X + pts[1].X + pts[2].X) / 3, (pts[0].Y + pts[1].Y + pts[2].Y) / 3, (pts[0].Z + pts[1].Z + pts[2].Z) / 3)
            return (test_pt - centroid).Length

        def is_door(three_supports, load_point, span_height_ratio=0.25):
            distance = point_plane_distance(three_supports, load_point)
            effective_span = distance_to_centroid(three_supports, load_point)
            if effective_span == 0:
                return False
            ratio = distance / effective_span
            return ratio <= span_height_ratio

        first_three = support_points[:3]
        if not is_door(first_three, load_point):
            return support_nodes
        else:
            for comb in combinations(support_nodes, 3):
                comb_points = [self.points[x] for x in list(comb)]
                if not is_door(list(comb_points), load_point):
                    combination.extend(list(comb))
                    missing = [x for x in support_nodes if x not in list(comb)]
                    if missing:
                        combination.extend(missing)
                    return combination
            return True

    def __find_edge_index(self, edge):
        if edge in self.edge_list or (edge[1], edge[0]) in self.edge_list:
            return self.edge_list.index(edge) if edge in self.edge_list else self.edge_list.index((edge[1], edge[0]))
        return -1

    def assemble(self):
        while True:
            if len(self.processed_nodes) == 0:
                first_supports, first_neighbour = self.__get_first_move()
                lines_to_add = []
                lines_indices = []

                for support in first_supports:
                    line = rs.AddLine(self.points[support], self.points[first_neighbour])
                    lines_to_add.append(line)
                    lines_indices.append(self.__find_edge_index((int(support), int(first_neighbour))))

                missing_edges = self.__check_missing_edges(first_supports)
                for missing_edge in missing_edges:
                    line = rs.AddLine(self.points[missing_edge[0]], self.points[missing_edge[1]])
                    lines_to_add.append(line)
                    lines_indices.append(self.__find_edge_index((int(missing_edge[0]), int(missing_edge[1]))))

                path = GH_Path(0)
                self.assembly_steps.AddRange(lines_to_add, path)
                self.assembly_step_line_indices.AddRange(lines_indices, path)

            elif len(self.processed_nodes) < len(self.points):
                non_rigid_candidates = self.__find_unprocessed_neighbors_subgraphs()
                rigid_candidates = [candidate for candidate in non_rigid_candidates if self.__can_node_be_rigid(candidate)]
                sorted_rigid_candidates = self.__sort_rigid_candidates(rigid_candidates)

                for candidate in sorted_rigid_candidates:
                    lines_to_add = []
                    lines_indices = []
                    nodes_to_connect_to = self.__get_possible_connections(candidate)

                    if len(nodes_to_connect_to) == 1 and nodes_to_connect_to[0] in self.rigid_indices:
                        continue

                    if len(nodes_to_connect_to) < 3:
                        for node in nodes_to_connect_to:
                            line = rs.AddLine(self.points[candidate], self.points[node])
                            lines_indices.append(self.__find_edge_index((int(candidate), int(node))))
                            lines_to_add.append(line)

                        self.processed_nodes.append(candidate)
                        path = GH_Path(self.assembly_steps.BranchCount)
                        self.assembly_steps.AddRange(lines_to_add, path)
                        self.assembly_step_line_indices.AddRange(lines_indices, path)

                    else:
                        nodes_sorted_indices = self.__get_sorted_supports(self.points[candidate], [self.points[x] for x in nodes_to_connect_to])
                        sorted_support_nodes = [nodes_to_connect_to[x] for x in nodes_sorted_indices]

                        if self.__check_if_door(sorted_support_nodes, candidate) == True:
                            continue
                        else:
                            sorted_support_indices = self.__check_if_door(sorted_support_nodes, candidate)

                        for point_index in sorted_support_indices:
                            line = rs.AddLine(self.points[candidate], self.points[point_index])
                            lines_indices.append(self.__find_edge_index((int(candidate), int(point_index))))
                            lines_to_add.append(line)

                        self.processed_nodes.append(candidate)
                        path = GH_Path(self.assembly_steps.BranchCount)
                        self.assembly_steps.AddRange(lines_to_add, path)
                        self.assembly_step_line_indices.AddRange(lines_indices, path)
            else:
                return self.assembly_steps

if not in_lines:
    raise ValueError('silly billy, no lines input')

if not in_rigid_points:
    raise ValueError('silly billy, no rigid points input')

if not in_start_point:
    raise ValueError('silly billy, no start point input')

my_truss = Trussemble(in_lines, in_rigid_points, in_start_point)
assembly_steps = my_truss.assemble()
processed_nodes = my_truss.processed_nodes
nodes = my_truss.points
processed_points = nodes
ordered_nodes = processed_points
line_indices = my_truss.assembly_step_line_indices
# ---------- end py3_trussemble ----------

# ----
panel_3 = Panel(crv)
panel_4 = Panel(pt_2)
panel_5 = Panel(pt)

# ---- group: in_BaseLines
crv_2 = Curve(<curve referenced from the Rhino model>)
base_edges = RemoteSender(crv_2)
input_lines = RemoteSender(crv)

# ---- group: viz_AssemblySequence
assembly_steps = Data(py3_trussemble.assembly_steps)
tstat_2 = TreeStatistics(Tree=assembly_steps)  # -> Paths, Length, Count
item = ListItem(List=tstat_2.Paths, Index=Slider(2, range=0..3), Wrap=True)
branch = TreeBranch(Tree=assembly_steps, Path=item, MaintainPaths=True)
# The Python script processes input curves and key rigid points to generate
# ordered assembly steps. This allows us to control the order and
# relationship between elements. The downstream components refine these outputs, segmenting the data based on specific parameters like chunk size and thickness, which is crucial for managing modular assemblies. The final portion splits results using masks to direct different segments through the workflow, ensuring only the relevant geometry is utilized at each stage. This setup is essential for automating a clear and structured assembly process.
previewlw = CustomPreviewLineweights(Geometry=branch, Shader=ColourSwatch(SwatchColor=RGB(255, 0, 217)), Thickness=Slider(10, range=0..40), Absolute=False)

# ----
panel_6 = Panel(assembly_steps)

# ---- group: calc_LinePartition
number_slider = Slider(6, range=0..9)
partition = PartitionList(List=assembly_steps, Size="3")
dom = ConstructDomain(DomainStart=0, DomainEnd=number_slider)
panel_7 = Panel(partition)
range = Range(Domain=dom, Steps=number_slider)  # -> flatten(Range)
concat_2 = Concatenate(FragmentA="{", FragmentB=range, FragmentA_2=";*}")
split = SplitTree(Data=partition, Masks=flatten(concat_2))  # -> Positive, Negative
line = Line(split.Positive)

# ---- group: calc__RobotOrientationToStructure
# base lines
pline = PolyLine(Vertices=pt_2, Closed=True)
explode = Explode(Curve=pline, Recursive=True)  # -> flatten(Segments), Vertices

# ----
# Real-Time Visualization
trigger = Trigger(Interval=2000, TimerInterval=2000, Target=[ur5_setup, py3])  # disabled
panel_8 = Panel("""UR
CM""")

robot_1_2 = RemoteReceiver(robot_1)
robot_1_3 = RemoteReceiver(robot_1)
robot_3_2 = RemoteReceiver(robot_3)
ur5_setup = Python3Script(RobotName=robot_1_2)  # -> out, RobotPosition, X_Axis, Y_Axis, Z_Axis, JointPoints, JointLines, SuccessMessage
# ---------- ur5_setup: Python ----------
import robolink as rl  # RoboDK API
import robodk as rdk
import Rhino.Geometry as rg
import math
import numpy as np

# === Inputs ===
# RobotName: Name of the robot in RoboDK (e.g., "UR5")

# Initialize outputs
RobotPosition = None
X_Axis = None
Y_Axis = None
Z_Axis = None
JointPoints = []
JointLines = []
SuccessMessage = ""

# Initialize RoboDK connection
RDK = rl.Robolink()

# Get the robot by name
robot = RDK.Item(RobotName, rl.ITEM_TYPE_ROBOT)

if not robot.Valid():
    SuccessMessage = f"Error: Could not find {RobotName} in RoboDK."
else:
    SuccessMessage = f"Connected to {RobotName} in RoboDK."

    # Get the robot's base pose
    robot_base = robot.Parent()
    if robot_base.Valid():
        base_pose = robot_base.Pose()
    else:
        base_pose = rdk.Mat()

    # Get the robot's current joint angles (degrees)
    joints_deg = robot.Joints().list()
    # Convert joint angles to radians
    joints_rad = [math.radians(angle) for angle in joints_deg]

    # UR5 standard DH parameters (in millimeters)
    d1 = 89.159
    a2 = -425.00
    a3 = -392.25
    d4 = 109.15
    d5 = 94.65
    d6 = 82.3

    alpha = [math.pi/2, 0, 0, math.pi/2, -math.pi/2, 0]
    a = [0, a2, a3, 0, 0, 0]
    d = [d1, 0, 0, d4, d5, d6]
    theta = [
        joints_rad[0],
        joints_rad[1],
        joints_rad[2],
        joints_rad[3],
        joints_rad[4],
        joints_rad[5],
    ]

    # Initialize the base transformation matrix
    T_base = np.array(base_pose.rows)
    # Ensure T_base is a 4x4 matrix
    if T_base.shape != (4, 4):
        SuccessMessage += " Error: Base pose matrix is not 4x4."
    else:
        # Initialize the transformation matrix
        T = T_base

        # Initialize joint positions list
        JointPoints = []

        # Store transformation matrices for each joint
        T_matrices = []

        for i in range(6):  # Six joints
            # DH parameters for current joint
            ai = a[i]
            alphai = alpha[i]
            di = d[i]
            thetai = theta[i]

            # Compute transformation matrix using DH parameters
            cos_theta = math.cos(thetai)
            sin_theta = math.sin(thetai)
            cos_alpha = math.cos(alphai)
            sin_alpha = math.sin(alphai)

            T_joint = np.array([
                [cos_theta, -sin_theta * cos_alpha,  sin_theta * sin_alpha, ai * cos_theta],
                [sin_theta,  cos_theta * cos_alpha, -cos_theta * sin_alpha, ai * sin_theta],
                [0,          sin_alpha,              cos_alpha,             di],
                [0,          0,                      0,                     1]
            ])

            # Update the overall transformation matrix
            T = np.dot(T, T_joint)

            # Save the transformation matrix for this joint
            T_matrices.append(T.copy())

            # Extract the position of the current joint
            position = T[:3, 3]

            # No conversion needed since we're working in millimeters
            joint_point = rg.Point3d(position[0], position[1], position[2])
            JointPoints.append(joint_point)

        # Create lines connecting the joints
        JointLines = []
        for i in range(1, len(JointPoints)):
            line = rg.Line(JointPoints[i - 1], JointPoints[i])
            JointLines.append(line)

        # Optionally, connect the base to the first joint
        if JointPoints:
            base_position = T_base[:3, 3]
            base_point = rg.Point3d(base_position[0], base_position[1], base_position[2])
            line = rg.Line(base_point, JointPoints[0])
            JointLines.insert(0, line)

        # Fetch the robot's pose relative to its base
        robot_pose = robot.Pose()

        # Compute the absolute pose of the TCP in the world coordinate system
        absolute_pose = base_pose * robot_pose

        # Extract position from the absolute pose
        position = absolute_pose.Pos()  # [x, y, z]

        # Create Rhino point for the robot's TCP position
        RobotPosition = rg.Point3d(position[0], position[1], position[2])

        # Extract orientation vectors from the rotation matrix of the absolute pose
        x_vector = rg.Vector3d(absolute_pose[0,0], absolute_pose[1,0], absolute_pose[2,0])
        y_vector = rg.Vector3d(absolute_pose[0,1], absolute_pose[1,1], absolute_pose[2,1])
        z_vector = rg.Vector3d(absolute_pose[0,2], absolute_pose[1,2], absolute_pose[2,2])

        # Scale vectors for visualization purposes
        scale_factor = 200  # Adjust as needed
        x_vector *= scale_factor
        y_vector *= scale_factor
        z_vector *= scale_factor

        # Create lines representing the robot's TCP axes
        X_Axis = rg.Line(RobotPosition, x_vector)
        Y_Axis = rg.Line(RobotPosition, y_vector)
        Z_Axis = rg.Line(RobotPosition, z_vector)

        # Optionally, connect the last joint to the TCP
        if JointPoints and RobotPosition:
            line = rg.Line(JointPoints[-1], RobotPosition)
            JointLines.append(line)
# ---------- end ur5_setup ----------
ur5_setup_2 = Python3Script(RobotName=robot_1_3)  # -> out, RobotPosition, X_Axis, Y_Axis, Z_Axis, JointPoints, JointLines, SuccessMessage, TCPPlane
# ---------- ur5_setup_2: Python ----------
import robolink as rl  # RoboDK API 
import robodk as rdk
import Rhino.Geometry as rg
import math
import numpy as np

# === Inputs ===
# RobotName: Name of the robot in RoboDK (e.g., "UR5")

# Initialize outputs
RobotPosition = None
X_Axis = None
Y_Axis = None
Z_Axis = None
JointPoints = []
JointLines = []
TCPPlane = None
SuccessMessage = ""

# Initialize RoboDK connection
RDK = rl.Robolink()

# Get the robot by name
robot = RDK.Item(RobotName, rl.ITEM_TYPE_ROBOT)

if not robot.Valid():
    SuccessMessage = f"Error: Could not find {RobotName} in RoboDK."
else:
    SuccessMessage = f"Connected to {RobotName} in RoboDK."

    # Get the robot's base pose
    robot_base = robot.Parent()
    if robot_base.Valid():
        base_pose = robot_base.Pose()
    else:
        base_pose = rdk.Mat()

    # Get the robot's current joint angles (degrees)
    joints_deg = robot.Joints().list()
    # Convert joint angles to radians
    joints_rad = [math.radians(angle) for angle in joints_deg]

    # UR5 standard DH parameters (in millimeters)
    d1 = 89.159
    a2 = -425.00
    a3 = -392.25
    d4 = 109.15
    d5 = 94.65
    d6 = 82.3

    alpha = [math.pi/2, 0, 0, math.pi/2, -math.pi/2, 0]
    a = [0, a2, a3, 0, 0, 0]
    d = [d1, 0, 0, d4, d5, d6]
    theta = [
        joints_rad[0],
        joints_rad[1],
        joints_rad[2],
        joints_rad[3],
        joints_rad[4],
        joints_rad[5],
    ]

    # Initialize the base transformation matrix
    T_base = np.array(base_pose.rows)
    # Ensure T_base is a 4x4 matrix
    if T_base.shape != (4, 4):
        SuccessMessage += " Error: Base pose matrix is not 4x4."
    else:
        # Initialize the transformation matrix
        T = T_base

        # Initialize joint positions list
        JointPoints = []

        # Store transformation matrices for each joint
        T_matrices = []

        for i in range(6):  # Six joints
            # DH parameters for current joint
            ai = a[i]
            alphai = alpha[i]
            di = d[i]
            thetai = theta[i]

            # Compute transformation matrix using DH parameters
            cos_theta = math.cos(thetai)
            sin_theta = math.sin(thetai)
            cos_alpha = math.cos(alphai)
            sin_alpha = math.sin(alphai)

            T_joint = np.array([
                [cos_theta, -sin_theta * cos_alpha,  sin_theta * sin_alpha, ai * cos_theta],
                [sin_theta,  cos_theta * cos_alpha, -cos_theta * sin_alpha, ai * sin_theta],
                [0,          sin_alpha,              cos_alpha,             di],
                [0,          0,                      0,                     1]
            ])

            # Update the overall transformation matrix
            T = np.dot(T, T_joint)

            # Save the transformation matrix for this joint
            T_matrices.append(T.copy())

            # Extract the position of the current joint
            position = T[:3, 3]

            # No conversion needed since we're working in millimeters
            joint_point = rg.Point3d(position[0], position[1], position[2])
            JointPoints.append(joint_point)

        # Create lines connecting the joints
        JointLines = []
        for i in range(1, len(JointPoints)):
            line = rg.Line(JointPoints[i - 1], JointPoints[i])
            JointLines.append(line)

        # Optionally, connect the base to the first joint
        if JointPoints:
            base_position = T_base[:3, 3]
            base_point = rg.Point3d(base_position[0], base_position[1], base_position[2])
            line = rg.Line(base_point, JointPoints[0])
            JointLines.insert(0, line)

        # Fetch the robot's pose relative to its base
        robot_pose = robot.Pose()

        # Compute the absolute pose of the TCP in the world coordinate system
        absolute_pose = base_pose * robot_pose

        # Extract position from the absolute pose
        position = absolute_pose.Pos()  # [x, y, z]

        # Create Rhino point for the robot's TCP position
        RobotPosition = rg.Point3d(position[0], position[1], position[2])

        # Extract orientation vectors from the rotation matrix of the absolute pose
        x_vector = rg.Vector3d(absolute_pose[0,0], absolute_pose[1,0], absolute_pose[2,0])
        y_vector = rg.Vector3d(absolute_pose[0,1], absolute_pose[1,1], absolute_pose[2,1])
        z_vector = rg.Vector3d(absolute_pose[0,2], absolute_pose[1,2], absolute_pose[2,2])

        # Create a plane for the TCP based on position and orientation vectors
        TCPPlane = rg.Plane(RobotPosition, x_vector, y_vector)

        # Scale vectors for visualization purposes
        scale_factor = 200  # Adjust as needed
        x_vector *= scale_factor
        y_vector *= scale_factor
        z_vector *= scale_factor

        # Create lines representing the robot's TCP axes
        X_Axis = rg.Line(RobotPosition, rg.Point3d(RobotPosition + x_vector))
        Y_Axis = rg.Line(RobotPosition, rg.Point3d(RobotPosition + y_vector))
        Z_Axis = rg.Line(RobotPosition, rg.Point3d(RobotPosition + z_vector))

        # Optionally, connect the last joint to the TCP
        if JointPoints and RobotPosition:
            line = rg.Line(JointPoints[-1], RobotPosition)
            JointLines.append(line)
# ---------- end ur5_setup_2 ----------
py3 = Python3Script(RobotName=robot_3_2)  # -> X_Axis, Y_Axis, Z_Axis, RobotPosition, JointPoints, JointLines, TCPPlane, SuccessMessage
# ---------- py3: Python ----------
import robolink as rl  # RoboDK API
import robodk as rdk
import Rhino.Geometry as rg
import math
import numpy as np

# === Inputs ===
# RobotName: Name of the robot in RoboDK (e.g., "COMAU NJ 60-2.2")

# Initialize outputs
RobotPosition = None
X_Axis = None
Y_Axis = None
Z_Axis = None
JointPoints = []
JointLines = []
TCPPlane = None
SuccessMessage = ""

# Initialize RoboDK connection
RDK = rl.Robolink()

# Get the robot by name
robot = RDK.Item(RobotName, rl.ITEM_TYPE_ROBOT)

if not robot.Valid():
    SuccessMessage = f"Error: Could not find {RobotName} in RoboDK."
else:
    SuccessMessage = f"Connected to {RobotName} in RoboDK."

    # Get the robot's base pose
    robot_base = robot.Parent()
    if robot_base.Valid():
        base_pose = robot_base.Pose()
    else:
        base_pose = rdk.Mat()

    # Get the robot's current joint angles (degrees)
    joints_deg = robot.Joints().list()
    # Convert joint angles to radians
    joints_rad = [math.radians(angle) for angle in joints_deg]

    # COMAU NJ 60-2.2 DH parameters (in millimeters and radians)
    d1 = 740
    a2 = 600
    a3 = 1200
    d4 = 1350
    d6 = 260

    # DH parameters for COMAU NJ 60-2.2
    alpha = [math.pi/2, 0, 0, math.pi/2, -math.pi/2, 0]
    a = [0, a2, a3, 0, 0, 0]
    d = [d1, 0, 0, d4, 0, d6]
    theta = [
        joints_rad[0],
        joints_rad[1],
        joints_rad[2],
        joints_rad[3],
        joints_rad[4],
        joints_rad[5],
    ]

    # Initialize the base transformation matrix
    T_base = np.array(base_pose.rows)
    # Ensure T_base is a 4x4 matrix
    if T_base.shape != (4, 4):
        SuccessMessage += " Error: Base pose matrix is not 4x4."
    else:
        # Initialize the transformation matrix
        T = T_base

        # Initialize joint positions list
        JointPoints = []

        # Store transformation matrices for each joint
        T_matrices = []

        for i in range(6):  # Six joints
            # DH parameters for current joint
            ai = a[i]
            alphai = alpha[i]
            di = d[i]
            thetai = theta[i]

            # Compute transformation matrix using DH parameters
            cos_theta = math.cos(thetai)
            sin_theta = math.sin(thetai)
            cos_alpha = math.cos(alphai)
            sin_alpha = math.sin(alphai)

            T_joint = np.array([
                [cos_theta, -sin_theta * cos_alpha,  sin_theta * sin_alpha, ai * cos_theta],
                [sin_theta,  cos_theta * cos_alpha, -cos_theta * sin_alpha, ai * sin_theta],
                [0,          sin_alpha,              cos_alpha,             di],
                [0,          0,                      0,                     1]
            ])

            # Update the overall transformation matrix
            T = np.dot(T, T_joint)

            # Save the transformation matrix for this joint
            T_matrices.append(T.copy())

            # Extract the position of the current joint
            position = T[:3, 3]

            # No conversion needed since we're working in millimeters
            joint_point = rg.Point3d(position[0], position[1], position[2])
            JointPoints.append(joint_point)

        # Create lines connecting the joints
        JointLines = []
        for i in range(1, len(JointPoints)):
            line = rg.Line(JointPoints[i - 1], JointPoints[i])
            JointLines.append(line)

        # Optionally, connect the base to the first joint
        if JointPoints:
            base_position = T_base[:3, 3]
            base_point = rg.Point3d(base_position[0], base_position[1], base_position[2])
            line = rg.Line(base_point, JointPoints[0])
            JointLines.insert(0, line)

        # Fetch the robot's pose relative to its base
        robot_pose = robot.Pose()

        # Compute the absolute pose of the TCP in the world coordinate system
        absolute_pose = base_pose * robot_pose

        # Extract position from the absolute pose
        position = absolute_pose.Pos()  # [x, y, z]

        # Create Rhino point for the robot's TCP position
        RobotPosition = rg.Point3d(position[0], position[1], position[2])

        # Extract orientation vectors from the rotation matrix of the absolute pose
        x_vector = rg.Vector3d(absolute_pose[0,0], absolute_pose[1,0], absolute_pose[2,0])
        y_vector = rg.Vector3d(absolute_pose[0,1], absolute_pose[1,1], absolute_pose[2,1])
        z_vector = rg.Vector3d(absolute_pose[0,2], absolute_pose[1,2], absolute_pose[2,2])

        # Create a plane for the TCP based on position and orientation vectors
        TCPPlane = rg.Plane(RobotPosition, x_vector, y_vector)

        # Scale vectors for visualization purposes
        scale_factor = 200  # Adjust as needed
        x_vector *= scale_factor
        y_vector *= scale_factor
        z_vector *= scale_factor

        # Create lines representing the robot's TCP axes
        X_Axis = rg.Line(RobotPosition, rg.Point3d(RobotPosition.X + x_vector.X, RobotPosition.Y + x_vector.Y, RobotPosition.Z + x_vector.Z))
        Y_Axis = rg.Line(RobotPosition, rg.Point3d(RobotPosition.X + y_vector.X, RobotPosition.Y + y_vector.Y, RobotPosition.Z + y_vector.Z))
        Z_Axis = rg.Line(RobotPosition, rg.Point3d(RobotPosition.X + z_vector.X, RobotPosition.Y + z_vector.Y, RobotPosition.Z + z_vector.Z))

        # Optionally, connect the last joint to the TCP
        if JointPoints and RobotPosition:
            line = rg.Line(JointPoints[-1], RobotPosition)
            JointLines.append(line)
# ---------- end py3 ----------

panel_9 = Panel(ur5_setup.Z_Axis)
panel_10 = Panel(ur5_setup.JointLines)
panel_11 = Panel(ur5_setup.RobotPosition)
panel_12 = Panel(ur5_setup.X_Axis)
panel_13 = Panel(ur5_setup.Y_Axis)
panel_14 = Panel(ur5_setup.SuccessMessage)
panel_15 = Panel(ur5_setup.JointPoints)

panel_16 = Panel(py3.RobotPosition)
panel_17 = Panel(py3.X_Axis)
panel_18 = Panel(py3.Y_Axis)
panel_19 = Panel(py3.JointLines)
panel_20 = Panel(py3.JointPoints)
panel_21 = Panel(py3.SuccessMessage)

item_2 = ListItem(List=[py3.X_Axis, ur5_setup.X_Axis], Index=0, Wrap=True)  # -> Item, Item1
item_3 = ListItem(List=[ur5_setup.Y_Axis, py3.Y_Axis], Index=0, Wrap=True)  # -> Item, Item1
item_4 = ListItem(List=[ur5_setup.Z_Axis, py3.Z_Axis], Index=0, Wrap=True)  # -> Item, Item1

previewlw_2 = CustomPreviewLineweights(
    Geometry=ur5_setup.JointLines,
    Shader=ColourSwatch(SwatchColor=RGB(184, 184, 184)),
    Thickness=Slider(0.5, range=0..200),
    Absolute=False)

item_5 = ListItem(List=[py3.RobotPosition, ur5_setup.RobotPosition], Index=0, Wrap=True)  # -> Item, Item1

swatch = ColourSwatch(SwatchColor=RGB(255, 0, 0))
swatch_2 = ColourSwatch(SwatchColor=RGB(82, 255, 3))
swatch_3 = ColourSwatch(SwatchColor=RGB(17, 101, 145))
entwine = Entwine(
    Branch00=item_2.Item,
    Branch01=item_3.Item,
    Branch02=item_4.Item,
    Branch03=item_2.Item1,
    Branch04=item_3.Item1,
    Branch05=item_4.Item1,
    FlattenInputs=True)
entwine_2 = Entwine(
    Branch00=swatch,
    Branch01=swatch_2,
    Branch02=swatch_3,
    Branch03=swatch,
    Branch04=swatch_2,
    Branch05=swatch_3,
    Branch06=swatch,
    Branch07=swatch_2,
    Branch08=swatch_3,
    FlattenInputs=True)
previewlw_3 = CustomPreviewLineweights(Geometry=entwine, Shader=entwine_2, Thickness=Slider(4, range=0..10), Absolute=False)

relay = Relay([item_5.Item, item_5.Item1])
rotate_plane_by_axis = RotatePlaneByAxis(Plane=reverse(relay), Axis="x", Angle=90)
tag = TextTag3D(Location=rotate_plane_by_axis, Text=panel_8, Size=100, Justification=8)

# ---- group: calc_Calculate Orientation Points
# Robot Orientation Point
panel_23 = Panel("2350")
division = Division(A="850", B="2")
division_2 = Division(A=panel_23, B="2")
Z = UnitZ(Factor=division_2)
Z_2 = UnitZ(Factor=division)

# ---- group: viz_3D MODEL
base_edges_2 = RemoteReceiver(base_edges)

# ---- group: in_TablePoints
# Physical Calibration
number_slider_2 = Slider(20, range=0..100)
tablepoints = Point([<point referenced from the Rhino model> x1683])
pt_3 = Point([<point referenced from the Rhino model> x3672])
tablepointscomau = RemoteSender(pt_3)
tablepointsur5 = RemoteSender(tablepoints)
Z_3 = UnitZ(Factor="20")
move = Move(Geometry=tablepointscomau, Motion=Z_3)  # -> Geometry, Transform
Z_4 = UnitZ(Factor=number_slider_2)
number_slider_3 = Slider(10, range=1..10)
number_slider_4 = Slider(5, range=1..10)
move_2 = Move(Geometry=tablepointsur5, Motion=Z_4)  # -> Geometry, Transform
tablepointscomau_2 = RemoteReceiver(tablepointscomau)
tablepointsur5_2 = RemoteReceiver(tablepointsur5)
pdecon = Deconstruct(Point=tablepointscomau_2)  # -> XComponent, YComponent, ZComponent
pdecon_2 = Deconstruct(Point=tablepointsur5_2)  # -> XComponent, YComponent, ZComponent
concat_3 = Concatenate(
    FragmentA="{",
    FragmentB=pdecon.XComponent,
    FragmentA_2=",",
    FragmentB_2=pdecon.YComponent,
    FragmentA_3=",",
    FragmentA_4=pdecon.ZComponent,
    FragmentA_5="}")  # -> flatten(Result)
concat_4 = Concatenate(
    FragmentA="{",
    FragmentB=pdecon_2.XComponent,
    FragmentA_2=",",
    FragmentB_2=pdecon_2.YComponent,
    FragmentA_3=",",
    FragmentA_4=pdecon_2.ZComponent,
    FragmentA_5="}")  # -> flatten(Result)

# ---- group: ctrl_RobotBaseSync
number_slider_5 = Slider(1105, range=0..3672)
dam = DataDam(DataA=Slider(1654, range=0..1683), BufferDelay=10000000, BufferMode=0)
robot_1_4 = RemoteReceiver(robot_1)
robot_3_3 = RemoteReceiver(robot_3)
py3_2 = Python3Script(
    TablePoints=tablepointscomau_2,
    RobotName=robot_3_3,
    PointIndex=number_slider_5,
    SetBase=Toggle(True),
    RotationZ=Slider(0, range=-360..360))  # -> out, BasePosition, SuccessMessage; inputs TablePoints: list of Point3d, PointIndex: Int32, RotationZ: Double
# ---------- py3_2: Python ----------
import robolink as rl        # RoboDK API for communication 
import robodk as rdk         # RoboDK robotic simulation environment
import Rhino.Geometry as rg  # Rhino geometry for working with 3D points
import math                  # Math module for calculations

# Initialize RoboDK link
RDK = rl.Robolink()
# Ensure that RobotName is defined correctly from Grasshopper
if 'RobotName' not in globals() or not RobotName:
    raise NameError("RobotName is not defined or empty.")

# Fetch robot item by name
robot = RDK.Item(RobotName, rl.ITEM_TYPE_ROBOT)

# Ensure the robot is found in RoboDK
if not robot.Valid():
    raise NameError(f"Error: Could not find robot '{RobotName}' in RoboDK.")

# Define functions
def connect_to_robot(robot_name) -> str:
    """
    Connect to the robot using its name and return a success or error message.

    :param robot_name: The name of the robot in RoboDK.
    :return: A message indicating success or error.
    """
    robot = RDK.Item(robot_name, rl.ITEM_TYPE_ROBOT)
    if not robot.Valid():
        return f"Error: Could not find robot '{robot_name}' in RoboDK."
    else:
        return f"Connected to robot '{robot_name}' in RoboDK."


def set_robot_base(robot, x, y, z, rz_deg) -> str:
    """
    Set the robot's base at a specific point (x, y, z) with a rotation along the Z-axis.

    :param robot: The robot item in RoboDK.
    :param x: X coordinate for the base position.
    :param y: Y coordinate for the base position.
    :param z: Z coordinate for the base position.
    :param rz_deg: Rotation angle around the Z-axis in degrees.
    :return: A success or error message regarding the base setting.
    """
    rz_rad = math.radians(rz_deg)  # Convert degrees to radians
    rotation_matrix = rdk.rotz(rz_rad)  # Create a rotation matrix
    translation_matrix = rdk.transl(x, y, z)  # Create a translation matrix
    base_pose = translation_matrix * rotation_matrix  # Combine translation and rotation

    robot_base = robot.Parent()  # Get the robot's base (parent in RoboDK)

    if robot_base.Valid():
        robot_base.setPose(base_pose)  # Set the base pose
        return f"Robot '{RobotName}' base set at Point {PointIndex} with RotationZ={rz_deg} degrees successfully."
    else:
        return "Error: Could not find or access the robot base."


def get_current_base_position(robot) -> str:
    """
    Retrieve the current base position and rotation of the robot.

    :param robot: The robot item in RoboDK.
    :return: A string containing the current base position and rotation details.
    """
    robot_base = robot.Parent()  # Get the robot's base

    if robot_base.Valid():
        current_base_pose = robot_base.Pose()  # Get the current pose of the base
        current_position = current_base_pose.Pos()  # Extract position (X, Y, Z)
        rx_rad, ry_rad, rz_rad = rdk.pose_2_xyzrpy(current_base_pose)[3:]  # Get rotation angles
        rz_deg = math.degrees(rz_rad)  # Convert Z-axis rotation to degrees
        return f"Current base position: X={current_position[0]}, Y={current_position[1]}, Z={current_position[2]}, RotationZ={rz_deg} degrees"
    else:
        return "Error: Could not retrieve base position."


def validate_point_index(point_index, points_list) -> bool:
    """
    Validate whether the point index is within the bounds of the points list.

    :param point_index: The index of the point to check.
    :param points_list: The list of points.
    :return: True if the index is valid, False otherwise.
    """
    return 0 <= point_index < len(points_list)


# Function to transform Rhino Z-axis values for RoboDK
def rhino_to_robodk_coordinates(point):
    """
    Transform a Rhino point to RoboDK-compatible coordinates, ensuring correct height (Z) adjustment.
    
    :param point: A Rhino point (with X, Y, Z values).
    :return: Transformed X, Y, Z coordinates.
    """
    # Assuming that Rhino Z needs to map directly to RoboDK Z and no additional transformation is needed.
    # If a transformation is needed (for example, flipping the Z axis), apply it here.
    return point.X, point.Y, point.Z

# Main script logic
SuccessMessage = connect_to_robot(RobotName)  # Connect to the robot
if "Error" not in SuccessMessage:
    # Validate the point index
    if not validate_point_index(PointIndex, TablePoints):
        SuccessMessage = f"Error: Point index {PointIndex} is out of bounds."
    else:
        point = TablePoints[PointIndex]  # Get the point at the specified index
        x, y, z = rhino_to_robodk_coordinates(point)  # Transform Rhino coordinates to RoboDK coordinates

        # Set the base if SetBase is true, otherwise retrieve current base position
        if SetBase:
            rz_deg = RotationZ  # Get the rotation value for the base
            SuccessMessage = set_robot_base(robot, x, y, z, rz_deg)
            BasePosition = f"Base set at: X={x}, Y={y}, Z={z}, RotationZ={rz_deg} degrees"
        else:
            BasePosition = get_current_base_position(robot)
else:
    BasePosition = ""

# Output the messages
print(SuccessMessage)
print(BasePosition)
# ---------- end py3_2 ----------
py3_3 = Python3Script(TablePoints=concat_4, RobotName=robot_1_4, PointIndex=dam, SetBase=Toggle(True), RotationZ=Slider(0, range=-360..360))  # -> out, BasePosition, SuccessMessage; inputs TablePoints: list of Point3d, PointIndex: Int32, RotationZ: Double; same code as py3_2
panel_24 = Panel(py3_2.BasePosition)
panel_25 = Panel(py3_2.SuccessMessage)
panel_26 = Panel(py3_3.BasePosition)
panel_27 = Panel(py3_3.SuccessMessage)

# ---- group: in_TablePoints / viz_TablePoints
points = PointList(Points=move_2.Geometry, Size=number_slider_4)
points_2 = PointList(Points=move.Geometry, Size=number_slider_3)

# ---- group: in_TablePoints (continued)
item_6 = ListItem(List=tablepointscomau_2, Index=number_slider_5, Wrap=True)
item_7 = ListItem(List=tablepointsur5_2, Index=dam, Wrap=True)
comaubase = RemoteSender(item_6)
ur5base = RemoteSender(item_7)

# ---- group: calc_Calculate Orientation Points / out_RobotBase
comaubase_2 = RemoteReceiver(comaubase)
ur5base_2 = RemoteReceiver(ur5base)

# ---- group: calc_Calculate Orientation Points (continued)
pt_4 = Point(ur5base_2)
pt_5 = Point(comaubase_2)
move_3 = Move(Geometry=pt_4, Motion=Z_2)  # -> Geometry, Transform
move_4 = Move(Geometry=pt_5, Motion=Z)  # -> Geometry, Transform

# ---- group: out_
orientation_point_b = RemoteSender(move_4.Geometry)
orientation_point_a = RemoteSender(move_3.Geometry)

# ---- group: calc_TaskDistribution
# Task Distribution Robots
orientation_point_a_2 = RemoteReceiver(orientation_point_a)
orientation_point_b_2 = RemoteReceiver(orientation_point_b)
py3_4 = Python3Script(EdgesTree=line, RobotPointA=orientation_point_a_2, RobotPointB=orientation_point_b_2)  # -> out, assembly_order, task_allocation; inputs EdgesTree: tree of Line, RobotPointA: Point3d, RobotPointB: Point3d
# ---------- py3_4: Python ----------
import Rhino.Geometry as rg
from Grasshopper import DataTree
from Grasshopper.Kernel.Data import GH_Path

# Inputs:
# EdgesTree - DataTree of Line objects representing truss edges
# RobotPointA - Point3d representing Robot A's base location
# RobotPointB - Point3d representing Robot B's base location

# Initialize outputs
assembly_order = DataTree[object]()
task_allocation = DataTree[str]()

# Collect all distances to determine the maximum distance for each robot
distances_A = []
distances_B = []

for path in EdgesTree.Paths:
    edges = EdgesTree.Branch(path)
    for edge in edges:
        mid_point = edge.PointAt(0.5)
        dist_to_A = mid_point.DistanceTo(RobotPointA)
        dist_to_B = mid_point.DistanceTo(RobotPointB)
        distances_A.append(dist_to_A)
        distances_B.append(dist_to_B)

max_dist_A = max(distances_A) if distances_A else 1.0
max_dist_B = max(distances_B) if distances_B else 1.0

# Process each branch
for path in EdgesTree.Paths:
    edges = EdgesTree.Branch(path)
    num_edges = len(edges)
    assembly_branch = []
    allocation_branch = []

    # Collect edge data
    edge_data = []
    for idx, edge in enumerate(edges):
        mid_point = edge.PointAt(0.5)
        dist_to_A = mid_point.DistanceTo(RobotPointA)
        dist_to_B = mid_point.DistanceTo(RobotPointB)
        rel_dist_to_A = dist_to_A / max_dist_A
        rel_dist_to_B = dist_to_B / max_dist_B
        edge_data.append({
            'index': idx,
            'edge': edge,
            'dist_to_A': dist_to_A,
            'dist_to_B': dist_to_B,
            'rel_dist_to_A': rel_dist_to_A,
            'rel_dist_to_B': rel_dist_to_B
        })

    if path.Indices[-1] == 0:
        # Branch {*;0}
        # Determine which robot is closer to the total of all edges
        total_rel_dist_A = sum(e['rel_dist_to_A'] for e in edge_data)
        total_rel_dist_B = sum(e['rel_dist_to_B'] for e in edge_data)
        if total_rel_dist_A <= total_rel_dist_B:
            closer_robot = '0'
            farther_robot = '1'
        else:
            closer_robot = '1'
            farther_robot = '0'

        # Assign edges to robots
        # Closer robot gets two edges (farthest from its base point)
        # Farther robot gets one edge (closest to its base point)
        if closer_robot == '0':
            edge_data.sort(key=lambda e: e['dist_to_A'], reverse=True)
            closer_edges = edge_data[:2]
            farther_edges = [e for e in edge_data if e not in closer_edges]
            farther_edge = min(farther_edges, key=lambda e: e['dist_to_B'])
        else:
            edge_data.sort(key=lambda e: e['dist_to_B'], reverse=True)
            closer_edges = edge_data[:2]
            farther_edges = [e for e in edge_data if e not in closer_edges]
            farther_edge = min(farther_edges, key=lambda e: e['dist_to_A'])

        # Assign to assembly order and task allocation
        assigned_edges = []
        for e in closer_edges:
            assigned_edges.append((e['index'], closer_robot, e['edge']))
        assigned_edges.append((farther_edge['index'], farther_robot, farther_edge['edge']))

        # Arrange edges to alternate for the first two edges
        assigned_edges.sort(key=lambda x: x[0])  # Sort by original index
        if assigned_edges[0][1] == assigned_edges[1][1]:
            # If first two edges are assigned to the same robot, swap the second with the third
            assigned_edges[1], assigned_edges[2] = assigned_edges[2], assigned_edges[1]

        # Add to outputs
        for idx, robot, edge in assigned_edges:
            assembly_branch.append(edge)
            allocation_branch.append(robot)
    else:
        # Branch {*;1}
        # Assign each edge to the relative closest robot
        for e in edge_data:
            idx = e['index']
            edge = e['edge']
            if e['rel_dist_to_A'] <= e['rel_dist_to_B']:
                robot = '0'
            else:
                robot = '1'
            assembly_branch.append(edge)
            allocation_branch.append(robot)

        # For each robot, sort their assigned edges by decreasing absolute distance
        # Since we need to maintain assembly order, we can sort the entire branch if necessary
        # For now, we keep the order as is, assuming the original order is acceptable

    # Add branches to outputs
    assembly_order.AddRange(assembly_branch, path)
    task_allocation.AddRange(allocation_branch, path)

# Outputs:
# AssemblyOrder - DataTree of edges in assembly order
# TaskAllocation - DataTree of strings indicating which robot ('0' or '1') is assigned to each edge
# ---------- end py3_4 ----------
# ---- group: out_
assembly_order = RemoteSender(py3_4.assembly_order)
task_allocation = RemoteSender(py3_4.task_allocation)

# ---- group: calc_
# target angle tuning
# Orientation Frames Robot B
orientation_point_b_3 = RemoteReceiver(orientation_point_b)
assembly_order_2 = RemoteReceiver(assembly_order)
task_allocation_2 = RemoteReceiver(task_allocation)
dispatch = Dispatch(List=assembly_order_2, DispatchPattern=task_allocation_2)  # -> ListA, ListB
line_2 = Line(dispatch.ListB)
midpt = CurveMiddle(Curve=line_2)
end = EndPoints(Curve=line_2)  # -> Start, End
pt_6 = Point(orientation_point_b_3)
pl_3pt = Plane3Pt(PointA=midpt, PointB=end.Start, PointC=pt_6)
rotate_plane_by_axis_2 = RotatePlaneByAxis(Plane=pl_3pt, Axis="x", Angle=90)
pflip = FlipPlane(Plane=rotate_plane_by_axis_2, ReverseX=False, ReverseY=False, SwapAxes=False)
pln = Plane(pflip)

# Orientation Frames Robot A
orientation_point_a_3 = RemoteReceiver(orientation_point_a)
assembly_order_3 = RemoteReceiver(assembly_order)
task_allocation_3 = RemoteReceiver(task_allocation)
dispatch_2 = Dispatch(List=assembly_order_3, DispatchPattern=task_allocation_3)  # -> ListA, ListB
line_3 = Line(dispatch_2.ListA)
midpt_2 = CurveMiddle(Curve=line_3)
end_2 = EndPoints(Curve=line_3)  # -> Start, End
pt_7 = Point(orientation_point_a_3)
pl_3pt_2 = Plane3Pt(PointA=midpt_2, PointB=end_2.Start, PointC=pt_7)
rotate_plane_by_axis_3 = RotatePlaneByAxis(Plane=pl_3pt_2, Axis="x", Angle=90)
pflip_2 = FlipPlane(Plane=rotate_plane_by_axis_3, ReverseX=False, ReverseY=False, SwapAxes=False)
pln_2 = Plane(pflip_2)

# ---- group: calc__RobotOrientationToStructure
# Robot Orientation To Structure
# average point of the 5 closest lines in the current state of assambly
flatten = FlattenTree(Tree=py3_4.assembly_order, Path="{0}")
listdexs = ListIndices(List=flatten)
split_2 = SplitList(List=flatten, Index=graft(listdexs))  # -> simplify(ListA), ListB
ins = InsertItems(List=split_2.ListA, Item=explode.Segments, Indices=0, Wrap=False)
number_slider_6 = Slider(5, range=0..10)
midpt_3 = CurveMiddle(Curve=ins)
item_8 = ListItem(List=midpt_3, Index="-1", Wrap=True)
dist = Distance(PointA=midpt_3, PointB=item_8)
dom_2 = ConstructDomain(DomainStart=0, DomainEnd=number_slider_6)
sort = SortList(Keys=dist, ValuesA=midpt_3)  # -> Keys, ValuesA
range_2 = Range(Domain=dom_2, Steps=number_slider_6)
line_4 = Line(flatten)
midpt_4 = CurveMiddle(Curve=line_4)
end_3 = EndPoints(Curve=line_4)  # -> Start, End
item_9 = ListItem(List=sort.ValuesA, Index=range_2, Wrap=True)
avr = Average(Input=item_9)  # -> flatten(ArithmeticMean)
pl_3pt_3 = Plane3Pt(PointA=midpt_4, PointB=end_3.Start, PointC=avr)
rotate_plane_by_axis_4 = RotatePlaneByAxis(Plane=pl_3pt_3, Axis="x", Angle=270)
assembly_order_4 = RemoteReceiver(assembly_order)
task_allocation_4 = RemoteReceiver(task_allocation)
pflip_3 = FlipPlane(Plane=rotate_plane_by_axis_4, ReverseX=False, ReverseY=False, SwapAxes=False)
unflatten = UnflattenTree(Tree=pflip_3, Guide=assembly_order_4)
dispatch_3 = Dispatch(List=unflatten, DispatchPattern=task_allocation_4)  # -> ListA, ListB

# ----
ur5base_3 = RemoteReceiver(ur5base)
comaubase_3 = RemoteReceiver(comaubase)
move_5 = Move(Geometry=ur5base_3, Motion=Vector(0, 0, -912))  # -> Geometry, Transform
box = CenterBox(Base=comaubase_3, X=300, Y=300, Z=30)
sph = Sphere(Base=comaubase_3, Radius=100)
dist_2 = Distance(PointA=move_5.Geometry, PointB=move_5.Transform)
ln = Line(StartPoint=move_5.Geometry, EndPoint=comaubase_3)
previewmat = CustomPreviewMaterials(
    Geometry=[box, sph],
    DiffuseColor=[ColourSwatch(SwatchColor=RGB(143, 143, 143)), ColourSwatch(SwatchColor=RGB(171, 72, 72))],
    Transparency=Slider(0, range=0..1))
linear_dimension = LinearDimension(BaseLine=ln, PointA=move_5.Geometry, PointB=comaubase_3)  # -> LinearDimension, BaseLine, PointA, PointB
rotate_plane_by_axis_5 = RotatePlaneByAxis(Plane=comaubase_3, Axis="x", Angle=90)
move_6 = Move(Geometry=rotate_plane_by_axis_5, Motion=Vector(0, 0, 200))  # -> Geometry, Transform
move_7 = Move(Geometry=linear_dimension.LinearDimension, Motion=Vector(-1000, 0, 0))  # -> Geometry, Transform
tag_2 = TextTag3D(Location=move_6.Geometry, Text="COMAU NJ 60-2.2", Size=100, Colour=RGB(0, 0, 0), Justification=8)

# ---- group: calc_
# Target Planes
number_slider_7 = Slider(0.5, range=0..1)
task_allocation_5 = RemoteReceiver(flatten(task_allocation))
twn2plns = TweenTwoPlanes(PlaneA=flatten(pln), PlaneB=flatten(dispatch_3.ListB), Factor=number_slider_7, Quaternion=True)  # -> flatten(Tween)
assembly_order_5 = RemoteReceiver(assembly_order)
twn2plns_2 = TweenTwoPlanes(PlaneA=flatten(pln_2), PlaneB=flatten(dispatch_3.ListA), Factor=number_slider_7, Quaternion=True)  # -> flatten(Tween)
weave = Weave(Pattern=task_allocation_5, Stream0=twn2plns, Stream1=twn2plns_2, NullGaps=False)
unflatten_2 = UnflattenTree(Tree=weave, Guide=assembly_order_5)
py3_5 = Python3Script(
    plane=unflatten_2,
    x_rot=Slider(0, range=0..180),
    y_rot=Slider(0, range=0..180),
    z_rot=Slider(90, range=0..180),
    swap_xy=False)  # -> out, a; inputs plane: Plane, swap_xy: Boolean
# ---------- py3_5: Python ----------
import Rhino.Geometry as rg
import math

def rotate_plane(plane, x_rot, y_rot, z_rot, swap_xy=False):
    """
    Rotates a plane around its X, Y, and Z axes and optionally swaps the X and Y axes while maintaining the Z-axis direction.

    :param plane: The input plane to rotate. Should be of type rg.Plane or list containing rg.Plane.
    :param x_rot: Rotation in degrees around the X-axis.
    :param y_rot: Rotation in degrees around the Y-axis.
    :param z_rot: Rotation in degrees around the Z-axis.
    :param swap_xy: Boolean to indicate if the X and Y axes should be swapped. Default is False.
    :return: The rotated (and possibly swapped) plane.
    """
    # Check if the input plane is a list and extract it if necessary
    if isinstance(plane, list):
        plane = plane[0]  # Assuming it's a single item list containing the plane

    if not isinstance(plane, rg.Plane):
        raise TypeError("Input must be of type Rhino.Geometry.Plane")

    # Create a copy of the original plane to work with
    rotated_plane = plane.Clone()

    # Store the original plane's origin to lock its position
    locked_origin = rotated_plane.Origin

    # Rotate around the plane's X-axis first (if needed)
    if x_rot != 0:
        rotation_x = rg.Transform.Rotation(math.radians(x_rot), rotated_plane.XAxis, locked_origin)
        rotated_plane.Transform(rotation_x)

    # Rotate around the Y-axis of the updated plane (if needed)
    if y_rot != 0:
        rotation_y = rg.Transform.Rotation(math.radians(y_rot), rotated_plane.YAxis, locked_origin)
        rotated_plane.Transform(rotation_y)

    # Rotate around the Z-axis of the updated plane (if needed)
    if z_rot != 0:
        rotation_z = rg.Transform.Rotation(math.radians(z_rot), rotated_plane.ZAxis, locked_origin)
        rotated_plane.Transform(rotation_z)

    # Set the origin of the rotated plane back to the locked origin to ensure no movement
    rotated_plane.Origin = locked_origin

    # Swap the X and Y axes if the swap_xy parameter is True
    if swap_xy:
        # Directly swap the X and Y axes
        new_x_axis = rotated_plane.YAxis
        new_y_axis = rotated_plane.XAxis

        # Calculate the resulting Z-axis using the cross-product of the swapped axes
        resulting_z_axis = rg.Vector3d.CrossProduct(new_x_axis, new_y_axis)

        # Check if the resulting Z-axis is aligned with the original Z-axis
        if resulting_z_axis.IsParallelTo(rotated_plane.ZAxis, 0.0001) == -1:
            # If it's the opposite direction, flip one of the swapped axes to correct it
            new_x_axis.Reverse()  # You can also reverse new_y_axis instead if needed

        # Create a new plane with swapped X and Y axes and the corrected Z direction
        rotated_plane = rg.Plane(locked_origin, new_x_axis, new_y_axis)

    return rotated_plane

# Inputs
# plane: Plane input from Grasshopper (type: rg.Plane or list containing rg.Plane)
# x_rot: Rotation in degrees around the X-axis (input 0 here)
# y_rot: Rotation in degrees around the Y-axis (input 0 here)
# z_rot: Rotation in degrees around the Z-axis (input 180 here)
# swap_xy: Boolean indicating whether to swap the X and Y axes

rotated_plane = rotate_plane(plane, x_rot, y_rot, z_rot, swap_xy)

# Output
a = rotated_plane
# ---------- end py3_5 ----------
target_planes = RemoteSender(unflatten_2)
pln_3 = Plane(py3_5.a)

# pick_up_planes_A
ur5base_4 = RemoteReceiver(ur5base)
xy = XYPlane(Origin=ur5base_4)
rotate_plane_by_axis_6 = RotatePlaneByAxis(Plane=xy, Axis="z", Angle=90)
move_8 = Move(Geometry=rotate_plane_by_axis_6, Motion=Vector(600, 0, -70))  # -> Geometry, Transform
arrlinear = LinearArray(Geometry=move_8.Geometry, Direction=Vector(60, 0, 0), Count=3)  # -> Geometry, Transform
pflip_4 = FlipPlane(Plane=arrlinear.Geometry, ReverseX=True, ReverseY=False, SwapAxes=False)
flipdirection = FlipDirection(Surface=pflip_4, Direction=0, Flip=True, Size=1)
pln_4 = Plane(flipdirection)

# pick_up_planes_B
comaubase_4 = RemoteReceiver(comaubase)
xy_2 = XYPlane(Origin=comaubase_4)
move_9 = Move(Geometry=xy_2, Motion=Vector(1000, 0, 0))  # -> Geometry, Transform
arrlinear_2 = LinearArray(Geometry=move_9.Geometry, Direction=Vector(0, 0, 0), Count=6)  # -> Geometry, Transform
flipdirection_2 = FlipDirection(Surface=arrlinear_2.Geometry, Direction=3, Flip=True, Size=1)
pln_5 = Plane(flipdirection_2)

# Approach planes
number_slider_8 = Slider(100, range=-1000..1000)
deplane = DeconstructPlane(Plane=pln_3)  # -> Origin, XAxis, YAxis, ZAxis
amp = Amplitude(Vector=deplane.ZAxis, Amplitude=number_slider_8)
move_10 = Move(Geometry=pln_3, Motion=expr("-x", amp))  # -> Geometry, Transform
pln_6 = Plane(move_10.Geometry)

# ---- group: viz_3D MODEL
# Display_TaskDis
number_slider_9 = Slider(32, range=0..32)
assembly_order_6 = RemoteReceiver(assembly_order)
task_allocation_6 = RemoteReceiver(task_allocation)
split_3 = SplitList(List=flatten(assembly_order_6), Index=number_slider_9)  # -> ListA, ListB
split_4 = SplitList(List=flatten(task_allocation_6), Index=number_slider_9)  # -> ListA, ListB
dispatch_4 = Dispatch(List=split_3.ListA, DispatchPattern=split_4.ListA)  # -> ListA, ListB
pipe = Pipe(Curve=dispatch_4.ListA, Radius=5, Caps=0)
pipe_2 = Pipe(Curve=dispatch_4.ListB, Radius=5, Caps=0)
entwine_3 = Entwine(Branch00=pipe, Branch01=pipe_2, FlattenInputs=True)
robotcurve = RemoteSender(entwine_3)

# ----
item_10 = ListItem(List=[py3.RobotPosition, ur5_setup.RobotPosition], Index=0, Wrap=True)  # -> Item, Item1
pt_8 = Point([item_10.Item, item_10.Item1, comaubase, ur5base])
sph_2 = Sphere(Base=pt_8, Radius=Slider(20, range=0..100))
preview = CustomPreview(Geometry=sph_2, Material=ColourSwatch(SwatchColor=RGB(0, 0, 0)))

# ---- group: out_Planes
pick_up_planes_a = RemoteSender(pln_4)
pick_up_planes_b = RemoteSender(pln_5)
approach_planes = RemoteSender(pln_6)
targetplanes = RemoteSender(pln_3)

# ----
# Guide planes B
input_lines_2 = RemoteReceiver(input_lines)
explode_2 = Explode(Curve=input_lines_2, Recursive=True)  # -> Segments, flatten(Vertices)
avr_2 = Average(Input=explode_2.Vertices)
dist_3 = Distance(PointA=avr_2, PointB=explode_2.Vertices)
sort_2 = SortList(Keys=dist_3)  # -> reverse(Keys), ValuesA
approach_planes_2 = RemoteReceiver(approach_planes)
task_allocation_7 = RemoteReceiver(task_allocation)
item_11 = ListItem(List=sort_2.Keys, Index=0, Wrap=True)
vec = VectorXYZ(XComponent=0, YComponent=item_11, ZComponent=item_11)  # -> Vector, Length
dispatch_5 = Dispatch(List=approach_planes_2, DispatchPattern=task_allocation_7)  # -> ListA, ListB
move_11 = Move(Geometry=avr_2, Motion=vec.Vector)  # -> Geometry, Transform
pl_origin = PlaneOrigin(Base=dispatch_5.ListB, Origin=move_11.Geometry)
vec2pt = Vector2Pt(PointA=move_11.Geometry, PointB=avr_2, Unitize=False)  # -> Vector, Length
padjust = AdjustPlane(Plane=pl_origin, Normal=vec2pt.Vector)  # -> flatten(Plane)
guide_planes_b = RemoteSender(padjust)

# ----
# display
number_slider_10 = Slider(2, range=0..10)
item_12 = ListItem(List=flatten(padjust), Index=number_slider_10, Wrap=True)
item_13 = ListItem(List=flatten(dispatch_5.ListB), Index=number_slider_10, Wrap=True)
flipdirection_3 = FlipDirection(Surface=flatten(item_12), Direction=0, Flip=True, Size=1)
flipdirection_4 = FlipDirection(Surface=flatten(item_13), Direction=0, Flip=False, Size=1)

py3_6 = Python3Script(
    plane=padjust,
    x_rot=Slider(0, range=0..180),
    y_rot=Slider(0, range=0..180),
    z_rot=Slider(90, range=0..180),
    swap_xy=False)  # -> out, a; inputs plane: Plane, swap_xy: Boolean; same code as py3_5
pln_7 = Plane(py3_6.a)

# ---- group: viz_3D MODEL (continued)
assembly_order_7 = RemoteReceiver(assembly_order)
target_planes_2 = RemoteReceiver(target_planes)

explode_3 = Explode(Curve=base_edges_2, Recursive=True)  # -> Segments, Vertices
gap_material = Slider(8, range=0..30)
thickness_montageband = Slider(12, range=0..30)

line_5 = Line(explode_3.Segments)
midpt_5 = CurveMiddle(Curve=line_5)
end_4 = EndPoints(Curve=line_5)  # -> Start, End
move_12 = Move(Geometry=midpt_5, Motion=Vector(0, 0, 10))  # -> Geometry, Transform
pl_3pt_4 = Plane3Pt(PointA=midpt_5, PointB=end_4.Start, PointC=move_12.Geometry)
rotate_plane_by_axis_7 = RotatePlaneByAxis(Plane=pl_3pt_4, Axis="x", Angle=270)
merge = Merge(Data1=explode_3.Segments, Data2=assembly_order_7)
merge_2 = Merge(Data1=rotate_plane_by_axis_7, Data2=target_planes_2)

hub_size = Slider(10.5, range=0..50)
node_size = Slider(50, range=0..100)
element_thickness_width = Slider(18, range=0..30)
overlap_node = Slider(1, range=0..50)
crv_3 = Curve(flatten(merge))
explode_4 = Explode(Curve=crv_3, Recursive=True)  # -> Segments, Vertices
cullpt = CullDuplicates(Points=flatten(explode_4.Vertices), Tolerance=1, CullMode=3)  # -> Points, Indices, Valence
sph_3 = Sphere(Base=cullpt.Points, Radius=node_size)
trim = TrimWithBreps(Curve=crv_3, Brep=sph_3)  # -> flatten(Inside), Outside
mp = MultiPipe(Curves=trim.Inside, NodeSize=hub_size, EndOffset=1, StrutSize=1, Segment=0, KinkAngle=0.6, CubeFit=0, Caps=2)  # -> graft(Pipe)
amp_2 = Amplitude(Vector=merge_2, Amplitude=element_thickness_width)  # -> flatten(Vector)
debrep = DeconstructBrep(Brep=mp)  # -> Faces, Edges, Vertices
join = BrepJoin(Breps=debrep.Faces)  # -> Breps, Closed

addition = Addition(A=node_size, B=gap_material)
subtraction = Subtraction(A=node_size, B=overlap_node)
neg = Negative(Value=subtraction)
ext = ExtendCurve(Curve=merge, Type=0, Start=neg, End=neg)
rotate_plane_by_axis_8 = RotatePlaneByAxis(Plane=merge_2, Axis="x", Angle=90)
offcrv = OffsetCurve(
    Curve=flatten(ext),
    Plane=flatten(rotate_plane_by_axis_8),
    Distance=expr("x/2", thickness_montageband),
    BothSides=expr("-x/2", thickness_montageband),
    Kinks=0,
    CapType=1)

line_6 = Line(ext)
depth_hole = Slider(25, range=0..100)
diameter_hole = Slider(2.5, range=0..10)
flip = FlipCurve(Curve=line_6)  # -> Curve, Flag
end_5 = EndPoints(Curve=line_6)  # -> Start, End
end_6 = EndPoints(Curve=flip.Curve)  # -> Start, End
vec2pt_2 = Vector2Pt(PointA=end_5.Start, PointB=end_5.End, Unitize=False)  # -> Vector, Length
vec2pt_3 = Vector2Pt(PointA=end_6.Start, PointB=end_6.End, Unitize=False)  # -> Vector, Length
line_7 = LineSDL(Start=end_5.Start, Direction=expr("-x", vec2pt_2.Vector), Length=depth_hole)  # -> flatten(Line)
line_8 = LineSDL(Start=end_6.Start, Direction=expr("-x", vec2pt_3.Vector), Length=depth_hole)  # -> flatten(Line)
pipe_3 = Pipe(Curve=line_7, Radius=expr("x/2", diameter_hole), Caps=0)
pipe_4 = Pipe(Curve=line_8, Radius=expr("x/2", diameter_hole), Caps=0)

subtraction_2 = Subtraction(A=addition, B=overlap_node)
neg_2 = Negative(Value=subtraction_2)
ext_2 = ExtendCurve(Curve=merge, Type=0, Start=neg_2, End=neg_2)
amp_3 = Amplitude(Vector=rotate_plane_by_axis_8, Amplitude=expr("x*2.5", hub_size))  # -> flatten(Vector)
offcrv_2 = OffsetCurve(
    Curve=flatten(ext_2),
    Plane=flatten(merge_2),
    Distance=expr("x/2", element_thickness_width),
    BothSides=expr("-x/2", element_thickness_width),
    Kinks=0,
    CapType=1)
offcrv_3 = OffsetCurve(
    Curve=flatten(ext),
    Plane=flatten(merge_2),
    Distance=expr("x/2", element_thickness_width),
    BothSides=expr("-x/2", element_thickness_width),
    Kinks=0,
    CapType=1)
extr = Extrude(Base=flatten(offcrv_2), Direction=flatten(amp_2))
extr_2 = Extrude(Base=flatten(offcrv_3), Direction=flatten(amp_2))
extr_3 = Extrude(Base=flatten(offcrv), Direction=flatten(amp_3))
cap = CapHoles(Brep=extr)
cap_2 = CapHoles(Brep=extr_2)
cap_3 = CapHoles(Brep=extr_3)
move_13 = Move(Geometry=cap, Motion=expr("-x/2", amp_2))  # -> Geometry, Transform
move_14 = Move(Geometry=cap_2, Motion=expr("-x/2", amp_2))  # -> Geometry, Transform
move_15 = Move(Geometry=cap_3, Motion=expr("-x/2", amp_3))  # -> Geometry, Transform
sdiff = SolidDifference(BrepsA=graft(join.Breps), BrepsB=flatten([move_15.Geometry, pipe_3, pipe_4]))

line_9 = Line(ext)
number_slider_11 = Slider(55, range=0..100)
flip_2 = FlipCurve(Curve=line_9)  # -> Curve, Flag
end_7 = EndPoints(Curve=line_9)  # -> Start, End
end_8 = EndPoints(Curve=flip_2.Curve)  # -> Start, End
vec2pt_4 = Vector2Pt(PointA=end_7.Start, PointB=end_7.End, Unitize=False)  # -> Vector, Length
vec2pt_5 = Vector2Pt(PointA=end_8.Start, PointB=end_8.End, Unitize=False)  # -> Vector, Length
line_10 = LineSDL(Start=end_7.Start, Direction=vec2pt_4.Vector, Length=number_slider_11)  # -> flatten(Line)
line_11 = LineSDL(Start=end_8.Start, Direction=vec2pt_5.Vector, Length=number_slider_11)  # -> flatten(Line)
deplane_2 = DeconstructPlane(Plane=merge_2)  # -> Origin, XAxis, YAxis, ZAxis
amp_4 = Amplitude(Vector=deplane_2.YAxis, Amplitude=50)  # -> flatten(Vector)
neg_3 = Negative(Value=amp_4)
merge_3 = Merge(Data1=graft(amp_4), Data2=graft(neg_3))  # -> simplify(Result)
extr_4 = Extrude(Base=graft(line_10), Direction=merge_3)
extr_5 = Extrude(Base=graft(line_11), Direction=merge_3)
join_2 = BrepJoin(Breps=extr_4)  # -> flatten(Breps), Closed
join_3 = BrepJoin(Breps=extr_5)  # -> flatten(Breps), Closed
merge_4 = Merge(Data1=graft(join_2.Breps), Data2=graft(join_3.Breps))
bbx = BrepBrep(BrepA=graft(move_14.Geometry), BrepB=merge_4)  # -> Curves, Points
flatten_2 = FlattenTree(Tree=merge_2, Path="{0}")
trim_2 = TrimTree(Tree=bbx.Curves, Depth=1)  # -> simplify(Tree)
graft_3 = GraftTree(Tree=flatten_2, IncludeEmptyLists=True, IncludeNullItems=True)  # -> simplify(Tree)
amp_5 = Amplitude(Vector=deplane_2.ZAxis, Amplitude=6)  # -> flatten(Vector)
offcrv_4 = OffsetCurve(Curve=trim_2, Plane=graft_3, Distance=-0.7, BothSides=0.5, Kinks=0, CapType=1)
trim_3 = TrimTree(Tree=offcrv_4, Depth=1)  # -> simplify(Tree)
neg_4 = Negative(Value=amp_5)
extr_6 = Extrude(Base=trim_3, Direction=graft(amp_5))  # -> graft(Extrusion)
extr_7 = Extrude(Base=trim_3, Direction=graft(neg_4))  # -> graft(Extrusion)
join_4 = BrepJoin(Breps=[extr_6, extr_7])  # -> flatten(Breps), Closed
cap_4 = CapHoles(Brep=join_4.Breps)

group = Group(Geometry=flatten(sdiff))
group_2 = Group(Geometry=flatten(move_13.Geometry))
group_3 = Group(Geometry=flatten(cap_4))

# ---- group: viz_3D MODEL / ctrl_3DPreview
robotcurve_2 = RemoteReceiver(robotcurve)
entwine_4 = Entwine(Branch00=move_13.Geometry, Branch01=sdiff, Branch02=cap_4, FlattenInputs=True)
list_4 = ValueList({"TASK ALLOCATION": 0, "3D PREVIEW": 1}, selected="TASK ALLOCATION")
data = Data(robotcurve_2)
data_2 = Data(entwine_4)
brep = Brep(entwine_4)
filter_4 = StreamFilter(Gate=list_4, Stream0=data, Stream1=data_2)
number_slider_12 = Slider(0.34, range=0..1)
entwine_5 = Entwine(
    Branch00=ColourSwatch(SwatchColor=RGB(255, 0, 0)),
    Branch01=ColourSwatch(SwatchColor=RGB(0, 208, 250)),
    FlattenInputs=True)
entwine_6 = Entwine(
    Branch00=ColourSwatch(SwatchColor=RGB(209, 186, 128)),
    Branch01=ColourSwatch(SwatchColor=RGB(240, 240, 240)),
    Branch02=ColourSwatch(SwatchColor=RGB(150, 150, 150)),
    FlattenInputs=True)
createatts = CreateAttributes(LayerName="Viz", enableFullPath=False)
previewmat_2 = CustomPreviewMaterials(Geometry=filter_4, DiffuseColor=entwine_5, Transparency=number_slider_12)
previewmat_3 = CustomPreviewMaterials(Geometry=filter_4, DiffuseColor=entwine_6, Transparency=number_slider_12)
bake = BakeGeometry(Bake=Toggle(False), Geometry=brep, Attributes=createatts, DeleteOldBakes=False, PreserveTrees=False)

# ----
sph_4 = Sphere(Base=ur5_setup.JointPoints, Radius=Slider(20.8, range=0..100))
panel_28 = Panel("{0;1}")
panel_29 = Panel("""J0
J1
J2
J3
J4
J5""")
previewmat_4 = CustomPreviewMaterials(Geometry=sph_4, DiffuseColor=ColourSwatch(SwatchColor=RGB(34, 223, 240)), Transparency=Slider(0.39, range=0..1))

entwine_7 = Entwine(Branch00=item_2.Item, Branch01=item_2.Item1, FlattenInputs=True)
end_9 = EndPoints(Curve=entwine_7)  # -> Start, End
tag_3 = TextTag(Location=end_9.End, Text="x")

entwine_8 = Entwine(Branch00=item_3.Item, Branch01=item_3.Item1, FlattenInputs=True)
entwine_9 = Entwine(Branch00=item_4.Item, Branch01=item_4.Item1, FlattenInputs=True)
data_3 = Data(sph_4)

end_10 = EndPoints(Curve=entwine_8)  # -> Start, End
end_11 = EndPoints(Curve=entwine_9)  # -> Start, End
tag_4 = TextTag(Location=end_10.End, Text="y")
tag_5 = TextTag(Location=end_11.End, Text="z")

panel_30 = Panel(data_3)
area = Area(Geometry=data_3)  # -> Area, Centroid

branch_2 = TreeBranch(Tree=area.Centroid, Path="{0;0}", MaintainPaths=True)  # -> flatten(Branch)
panel_31 = Panel(branch_2)

rotate_plane_by_axis_9 = RotatePlaneByAxis(Plane=branch_2, Axis="x", Angle=90)
tag_6 = TextTag3D(Location=rotate_plane_by_axis_9, Text=panel_29, Size=20, Colour=ColourSwatch(SwatchColor=RGB(0, 0, 0)), Justification=5)

Y = UnitY(Factor=Slider(-300, range=-1000..1000))

# ----
# script v8
pln_8 = Plane(Plane(origin=(644.5, -109.3, 1520.95), x=(0, -1, 0), y=(0, 0, -1)))
pln_9 = Plane(Plane(origin=(1700.5, 2100, 1650), x=(0, 0, -1), y=(0, 1, 0)))
pick_up_planes_a_2 = RemoteReceiver(pick_up_planes_a)
pick_up_planes_b_2 = RemoteReceiver(pick_up_planes_b)
task_allocation_8 = RemoteReceiver(task_allocation)
pln_10 = Plane()
pln_11 = Plane()
panel_32 = Panel("gripper = 0")
panel_33 = Panel("gripper = 1")
targetplanes_2 = RemoteReceiver(targetplanes)
panel_34 = Panel("pause")
panel_35 = Panel("waiting")
bool = Boolean(invert(task_allocation_8))
int = Integer(bool)

pln_12 = Plane(pln_8)
rot3d = Rotate3D(Geometry=pln_12, Angle=1.570796327, Center=ur5base, Axis=Vector(0, 0, 1))  # -> Geometry, Transform
move_16 = Move(Geometry=rot3d.Geometry, Motion=Y)  # -> Geometry, Transform
guide_plane_a = RemoteSender(move_16.Geometry)
pln_13 = Plane(guide_plane_a)
deplane_3 = DeconstructPlane(Plane=pln_13)  # -> Origin, XAxis, YAxis, ZAxis
panel_36 = Panel(pln_13)
amp_6 = Amplitude(Vector=deplane_3.ZAxis, Amplitude=50)
vdis = VectorDisplay(Anchor=deplane_3.Origin, Vector=amp_6)

py3_7 = Python3Script(
    target_planes=targetplanes_2,
    task_allocation=int,
    approach_planes=pln_6,
    pick_up_planes_A=pick_up_planes_a_2,
    pick_up_planes_B=pick_up_planes_b_2,
    home_plane_A=pln_8,
    home_plane_B=pln_9,
    guide_planes_A=pln_13,
    guide_planes_B=pln_7)  # -> out, robotA_commands, robotB_commands, flatten(robotA_status), flatten(robotB_status); inputs target_planes: tree, task_allocation: tree of Int32, approach_planes: tree of Plane, pick_up_planes_A: list of Plane, pick_up_planes_B: list of Plane, guide_planes_A: list of Plane, guide_planes_B: list
# ---------- py3_7: Python ----------
import Rhino.Geometry as rg
import Grasshopper
from Grasshopper.Kernel.Data import GH_Path

# Inputs:
# target_planes - DataTree of Planes in assembly order
# approach_planes - DataTree of Planes corresponding to target_planes (optional)
# task_allocation - DataTree of integers (0 or 1) indicating robot assignment (0 for A, 1 for B)
# pick_up_planes_A - List of Planes for Robot A's pick-up points
# pick_up_planes_B - List of Planes for Robot B's pick-up points
# pause_command - Command to pause the robot (optional)
# waiting_command - Command for waiting state (optional)
# home_plane_A - Plane for Robot A's home position (constant for each set)
# home_plane_B - Plane for Robot B's home position (constant for each set)
# guide_planes_A - List of optional guide planes for Robot A (constant for each set)
# guide_planes_B - List of optional guide planes for Robot B (constant for each set)

# Initialize output data trees
robotA_commands = Grasshopper.DataTree[object]()
robotB_commands = Grasshopper.DataTree[object]()
robotA_status = Grasshopper.DataTree[str]()
robotB_status = Grasshopper.DataTree[str]()

# Initialize gripper states and last edge counters for both robots
gripper_state = {'A': 0, 'B': 0}
last_edge_counter = {'A': None, 'B': None}

# Initialize edge counter and pickup plane indices
edge_counter = 0
pickup_index = {'A': 0, 'B': 0}

# Get the total number of pickup planes for each robot
num_pickup_planes_A = len(pick_up_planes_A) if pick_up_planes_A else 1
num_pickup_planes_B = len(pick_up_planes_B) if pick_up_planes_B else 1

# Process each branch of the target_planes DataTree
for path in target_planes.Paths:
    # Extract planes, approaches, and allocations from the current branch
    planes = target_planes.Branch(path)
    approaches = approach_planes.Branch(path) if approach_planes and approach_planes.PathExists(path) else [None] * len(planes)
    allocations = task_allocation.Branch(path)
    num_edges = len(planes)
    
    # Prepare lists to store actions per robot for the current branch
    actions_A = []
    actions_B = []

    # Process each edge (target plane) in the current branch
    for idx in range(num_edges):
        edge_counter += 1
        plane = planes[idx]
        approach = approaches[idx] if idx < len(approaches) else None
        robot = allocations[idx]
        assigned_robot = 'A' if robot == 0 else 'B'
        other_robot = 'B' if assigned_robot == 'A' else 'A'
        last_edge_counter[assigned_robot] = edge_counter

        # Determine pickup plane and home plane based on assigned robot
        if assigned_robot == 'A':
            pickup_plane = pick_up_planes_A[pickup_index['A'] % num_pickup_planes_A] if num_pickup_planes_A > 0 else None
            home_plane = home_plane_A
            guide_plane = guide_planes_A[0] if guide_planes_A else None
            pickup_index['A'] += 1
        else:
            pickup_plane = pick_up_planes_B[pickup_index['B'] % num_pickup_planes_B] if num_pickup_planes_B > 0 else None
            home_plane = home_plane_B
            guide_plane = guide_planes_B[0] if guide_planes_B else None
            pickup_index['B'] += 1

        # Define the sequence of steps for the assigned robot in the required order
        steps_robot = [
            ("Move to home plane", home_plane if home_plane else "No home plane provided"),
            ("Move to pick up", pickup_plane if pickup_plane else "No pickup plane provided"),
            ("Return to home plane", home_plane if home_plane else "No home plane provided"),
            ("Move to guide plane", guide_plane if guide_plane else "No guide plane provided"),
        ]

        if approach:
            steps_robot.append((f"Move to approach plane {edge_counter}", approach))

        steps_robot.append((f"Move to target {edge_counter}", plane))

        if approach:
            steps_robot.append((f"Return to approach plane {edge_counter}", approach))

        steps_robot.append(("Return to guide plane", guide_plane if guide_plane else "No guide plane provided"))

        steps_robot.append(("Return to home plane", home_plane if home_plane else "No home plane provided"))

        # Add steps to the corresponding robot's action list
        if assigned_robot == 'A':
            actions_A.extend(steps_robot)
        else:
            actions_B.extend(steps_robot)

        # Create synchronized waiting steps for the other robot
        waiting_status = f"Holding edge {last_edge_counter[other_robot]}" if gripper_state[other_robot] == 1 else "Waiting for other robot"
        waiting_steps = [(waiting_status, waiting_command)] * len(steps_robot)

        if other_robot == 'A':
            actions_A.extend(waiting_steps)
        else:
            actions_B.extend(waiting_steps)

    # Synchronize actions between robots and add them to the output data trees
    total_steps = max(len(actions_A), len(actions_B))
    for i in range(total_steps):
        sub_path = GH_Path(path).AppendElement(i)
        # Add Robot A actions and statuses
        if i < len(actions_A):
            status_A, command_A = actions_A[i]
        else:
            status_A, command_A = "Waiting for other robot", waiting_command
        robotA_status.Add(status_A, sub_path)
        robotA_commands.Add(command_A, sub_path)
        
        # Add Robot B actions and statuses
        if i < len(actions_B):
            status_B, command_B = actions_B[i]
        else:
            status_B, command_B = "Waiting for other robot", waiting_command
        robotB_status.Add(status_B, sub_path)
        robotB_commands.Add(command_B, sub_path)

# Outputs
RobotA_Command = robotA_commands
RobotB_Command = robotB_commands
RobotA_Status = robotA_status
RobotB_Status = robotB_status
# ---------- end py3_7 ----------
path_mapper = PathMapper(py3_7.robotA_commands, source=["{A;B;C}", "{A;B;C;D}"], target=["{A}", "{A}"])
status_a = RemoteSender(py3_7.robotA_status)
status_b = RemoteSender(py3_7.robotB_status)
null = NullItem(Item=path_mapper)  # -> NullFlags, InvalidFlags, Description
cull_3 = CullPattern(List=path_mapper, CullPattern=invert(null.NullFlags))
commands_a = RemoteSender(flatten(cull_3))

path_mapper_2 = PathMapper(py3_7.robotB_commands, source=["{A;B;C}", "{A;B;C;D}"], target=["{A}", "{A}"])
null_2 = NullItem(Item=path_mapper_2)  # -> NullFlags, InvalidFlags, Description
cull_4 = CullPattern(List=path_mapper_2, CullPattern=invert(null_2.NullFlags))

commands_b = RemoteSender(flatten(cull_4))

# ----
# Status
# Command
# UR5
# COMAU
panel_37 = Panel(commands_a)
panel_38 = Panel(commands_b)
status_a_2 = RemoteReceiver(status_a)
status_b_2 = RemoteReceiver(status_b)
panel_39 = Panel(status_a_2)
panel_40 = Panel(status_b_2)
assembly_order_8 = RemoteReceiver(assembly_order)
task_allocation_9 = RemoteReceiver(task_allocation)
panel_41 = Panel(task_allocation_9)
panel_42 = Panel(assembly_order_8)

commands_a_2 = RemoteReceiver(commands_a)
commands_b_2 = RemoteReceiver(commands_b)
pln_14 = Plane(flatten(commands_a_2))
pln_15 = Plane(commands_b_2)

panel_43 = Panel(pln_14)
ur5planes = RemoteSender(commands_a)
py3_8 = Python3Script(Planes=ur5planes)  # -> out, FilteredPlanes; inputs Planes: list of Plane, IndicesToRemove: list of Int32
# ---------- py3_8: Python ----------
"""
Inputs:
    Planes (list of Rhino.Geometry.Plane): The list of Rhino planes.
    IndicesToRemove (list of int): The list of integers specifying the indices to be removed.

Output:
    FilteredPlanes (list of Rhino.Geometry.Plane): The filtered list of planes.
"""

# Check if the inputs are valid
if Planes and IndicesToRemove:
    # Convert indices list to a set for faster membership checking
    indices_to_remove_set = set(IndicesToRemove)
    
    # Create a new list of planes, excluding those at specified indices
    FilteredPlanes = [plane for i, plane in enumerate(Planes) if i not in indices_to_remove_set]
else:
    # If inputs are invalid or empty, output an empty list
    FilteredPlanes = []
# ---------- end py3_8 ----------
panel_44 = Panel(py3_8.FilteredPlanes)

comauplanes = RemoteSender(flatten(commands_b))
py3_9 = Python3Script(Planes=comauplanes)  # -> out, FilteredPlanes; inputs Planes: list of Plane, IndicesToRemove: list of Int32; same code as py3_8
panel_46 = Panel(py3_9.FilteredPlanes)

# ----
# preview plane A
deplane_4 = DeconstructPlane(Plane=pln_14)  # -> Origin, XAxis, YAxis, ZAxis
amp_7 = Amplitude(Vector=deplane_4.ZAxis, Amplitude=50)
vdis_2 = VectorDisplay(Anchor=deplane_4.Origin, Vector=amp_7)

# ----
# preview plane B
deplane_5 = DeconstructPlane(Plane=pln_15)  # -> Origin, XAxis, YAxis, ZAxis
amp_8 = Amplitude(Vector=deplane_5.ZAxis, Amplitude=50)
vdis_3 = VectorDisplay(Anchor=deplane_5.Origin, Vector=amp_8)  # disabled

comauplanes_2 = RemoteReceiver(comauplanes)
panel_47 = Panel(comauplanes_2)
py3_10 = Python3Script(Planes=comauplanes_2, BranchSize="9")  # -> out, simplify(BranchedPlanes); inputs Planes: list of Plane, BranchSize: Int32
# ---------- py3_10: Python ----------
import Rhino
import Grasshopper as gh
from Grasshopper import DataTree
from Grasshopper.Kernel.Data import GH_Path

"""
Inputs:
    Planes (list of Rhino.Geometry.Plane): The list of Rhino planes.
    BranchSize (int): The number of planes per branch.

Output:
    BranchedPlanes (DataTree[object]): The resulting tree of branches with planes.
"""

# Create an empty DataTree to store branches of planes
BranchedPlanes = DataTree[object]()

# Check if the inputs are valid
if Planes and BranchSize > 0:
    # Iterate and create branches
    for i in range(0, len(Planes), BranchSize):
        # Create a path for each branch using the index divided by BranchSize
        path = GH_Path(i // BranchSize)
        # Add planes to the tree under this path
        for j in range(BranchSize):
            index = i + j
            if index < len(Planes):
                BranchedPlanes.Add(Planes[index], path)
# ---------- end py3_10 ----------
panel_48 = Panel(py3_10.BranchedPlanes)

bang = ExplodeTree(Data=py3_10.BranchedPlanes)  # -> flatten(Branch0), flatten(Branch1), flatten(Branch2), flatten(Branch3), flatten(Branch4), flatten(Branch5)
element1 = RemoteSender(bang.Branch0)
element2 = RemoteSender(bang.Branch1)
element3 = RemoteSender(bang.Branch2)
element4 = RemoteSender(bang.Branch3)
element5 = RemoteSender(bang.Branch4)
element6 = RemoteSender(bang.Branch5)

ur5planes_2 = RemoteReceiver(ur5planes)
py3_11 = Python3Script(Planes=flatten(ur5planes_2), BranchSize="9")  # -> out, BranchedPlanes; inputs Planes: list of Plane, BranchSize: Int32; same code as py3_10
panel_49 = Panel(py3_11.BranchedPlanes)
bang_2 = ExplodeTree(Data=py3_11.BranchedPlanes)  # -> Branch0, flatten(Branch1), flatten(Branch2), flatten(Branch3), flatten(Branch4), flatten(Branch5), flatten(Branch6)
panel_50 = Panel("""1
4""")
panel_51 = Panel("""50.00
30.00""")
element1_2 = RemoteSender(bang_2.Branch0)
element3_2 = RemoteSender(bang_2.Branch2)
element4_2 = RemoteSender(bang_2.Branch3)
element2_2 = RemoteSender(bang_2.Branch1)
robot_1_5 = RemoteReceiver(robot_1)

element6_2 = RemoteSender(bang_2.Branch6)
element5_2 = RemoteSender(bang_2.Branch5)

py3_12 = Python3Script(
    RobotName=robot_1_5,
    UpdateRoboDK=Toggle(False),
    PlanesList=element5_2,
    SetSpeedOrder=panel_50,
    SetSpeedValue=panel_51,
    StopOrder="6")  # -> out, SuccessMessage, TargetPoses, Program, TCPOrientations, PlaneExtra; inputs PlanesList: list of Plane, SetSpeedOrder: list of Int32, SetSpeedValue: list of Double, StopOrder: list of Int32
# ---------- py3_12: Python ----------
import robolink as rl    # RoboDK API for controlling and communicating with RoboDK     
import robodk as rdk     # RoboDK tools, such as matrix operations and other utilities
import robodk.robodialogs as dialogs  # Import the dialog functions from RoboDK
import Rhino.Geometry as rg  # Import Rhino.Geometry module as rg
import math

# === Inputs ===
# RobotName: Name of the robot in RoboDK (e.g., "UR5")
# UpdateRoboDK: Boolean toggle to execute the script and update RoboDK when True
# PlanesList: List of Rhino Plane objects (each plane contains both target point and orientation)
# SetSpeedOrder: List of indices where speed commands should be inserted in the program
# SetSpeedValue: List of speed values corresponding to each SetSpeedOrder index
# StopOrder: List of indices where stop commands should be inserted in the program

# Initialize global variables for speed, acceleration, and blending radius
global speed_ms, accel_mss, blend_radius_m
speed_ms = None
accel_mss = None
blend_radius_m = None

# Initialize outputs
SuccessMessage = ""
TargetPoses = []  # List of converted poses
Program = ""
TCPOrientations = []
TargetPointCoordinates = []
PlaneExtra = []  # Unreachable planes for other robots to attempt

def plane_to_pose(plane):
    """
    Converts a Rhino plane to a RoboDK pose (4x4 matrix).
    Parameters:
        - plane: Rhino.Geometry.Plane object to be converted.
    Returns:
        - pose: RoboDK 4x4 transformation matrix (rdk.Mat).
    """
    pose = rdk.Mat([
        [plane.XAxis.X, plane.YAxis.X, plane.ZAxis.X, plane.OriginX],
        [plane.XAxis.Y, plane.YAxis.Y, plane.ZAxis.Y, plane.OriginY],
        [plane.XAxis.Z, plane.YAxis.Z, plane.ZAxis.Z, plane.OriginZ],
        [0, 0, 0, 1]
    ])
    return pose

def format_tcp_orientation(plane, milestone):
    """
    Formats the TCP orientation (X, Y, Z axes) for a given milestone.
    Parameters:
        - plane: Rhino.Geometry.Plane object representing the TCP.
        - milestone: String representing the step or target being reported.
    Returns:
        - String formatted with the X, Y, and Z axes of the TCP.
    """
    x_axis = plane.XAxis
    y_axis = plane.YAxis
    z_axis = plane.ZAxis
    return f"TCP orientation at {milestone}:\n  X-axis: {x_axis}\n  Y-axis: {y_axis}\n  Z-axis: {z_axis}"

def format_target_coordinates(plane, milestone):
    """
    Formats the target point coordinates as a string for a given milestone.
    Parameters:
        - plane: Rhino.Geometry.Plane object representing the target.
        - milestone: String representing the step or target being reported.
    Returns:
        - String formatted with the target point's coordinates.
    """
    return f"{plane.OriginX}, {plane.OriginY}, {plane.OriginZ}"

# Main Logic for Processing Inputs and Creating the RoboDK Program
if not RobotName:
    SuccessMessage = "Error: RobotName is required."
elif not PlanesList or not isinstance(PlanesList, list):
    SuccessMessage = "Error: PlanesList must be a list of Rhino Plane objects."
elif any(not isinstance(plane, rg.Plane) for plane in PlanesList):
    SuccessMessage = "Error: All elements in PlanesList must be Rhino Plane objects."
elif UpdateRoboDK is None:
    SuccessMessage = "Error: UpdateRoboDK toggle is required."
elif not UpdateRoboDK:
    SuccessMessage = "UpdateRoboDK is set to False. No action taken."
else:
    # Connect to RoboDK only if UpdateRoboDK is True
    RDK = rl.Robolink()  # Initialize RoboDK connection
    SuccessMessage = "Connected to RoboDK."
    
    # Retrieve the robot by name
    robot = RDK.Item(RobotName, rl.ITEM_TYPE_ROBOT)
    
    if not robot.Valid():
        SuccessMessage += f"\nError: Could not find {RobotName} in RoboDK."
    else:
        SuccessMessage += f"\nFound robot '{robot.Name()}' in RoboDK."
        
        # Get the robot's base and tool
        robot_base = robot.Parent()
        tool = robot.getLink(rl.ITEM_TYPE_TOOL)
        
        if not robot_base.Valid() or not tool.Valid():
            SuccessMessage += "\nCannot proceed without valid base and tool."
        else:
            # Set the robot to its home position before starting
            robot.MoveJ(robot.JointsHome())

            # Create a new program in RoboDK
            program_name = "MoveThroughPlanesProgram"
            program = RDK.AddProgram(program_name, robot)
            program.setFrame(robot_base)
            program.setTool(tool)

            # Set default values for speed, acceleration, and blending
            speed_ms = 0.3
            accel_mss = 3.0
            blend_radius_m = 0.001

            # Variables to track current index in planes and SetSpeedOrder
            speed_index = 0
            stop_index = 0

            # Process each plane in PlanesList independently
            for idx, plane in enumerate(PlanesList):
                # Check if we need to insert a stop command here
                if StopOrder and stop_index < len(StopOrder) and idx == StopOrder[stop_index]:
                    # Display a message to the user and wait for confirmation to proceed
                    user_choice = dialogs.ShowMessageOkCancel("Process stopped. Click OK to continue.", "User Confirmation")
                    
                    if not user_choice:  # If user clicks "Cancel"
                        SuccessMessage += f"\nProcess cancelled by the user at Plane {idx + 1}."
                        break  # Stop execution or exit the loop

                    # Insert a pause instruction into the RoboDK program
                    program.RunInstruction("Pause", True)
                    SuccessMessage += f"\nProcess continued at Plane {idx + 1}."
                    stop_index += 1

                # Check if we need to insert a speed change command here
                if SetSpeedOrder and speed_index < len(SetSpeedOrder) and idx == SetSpeedOrder[speed_index]:
                    # Change the speed of the robot in the program
                    speed_value = SetSpeedValue[speed_index]
                    program.setSpeed(speed_value)
                    SuccessMessage += f"\nSpeed set to {speed_value} at Plane {idx + 1}."
                    speed_index += 1

                # Convert the Rhino plane to a RoboDK pose
                target_pose_robot = plane_to_pose(plane)
                base_pose_inv = robot_base.Pose().inv()  # Inverse of the base pose matrix
                target_pose_relative = base_pose_inv * target_pose_robot  # Calculate the relative target pose

                try:
                    # Attempt a linear movement to the target pose
                    robot.MoveL(target_pose_relative, False)
                    TargetPoses.append(target_pose_relative)
                    
                    # Create a target in RoboDK for this pose
                    target_name = f"Plane_{idx + 1}"
                    target = RDK.AddTarget(target_name, robot_base, robot)
                    target.setAsCartesianTarget()
                    target.setPose(target_pose_relative)
                    program.MoveL(target)
                    SuccessMessage += f"\nPlane {idx + 1} reachable with linear movement."

                except Exception as e:
                    try:
                        # If linear movement fails, attempt a joint movement to the target pose
                        robot.MoveJ(target_pose_relative, False)
                        TargetPoses.append(target_pose_relative)
                        
                        # Create a target in RoboDK for this pose
                        target_name = f"Plane_{idx + 1}"
                        target = RDK.AddTarget(target_name, robot_base, robot)
                        target.setAsCartesianTarget()
                        target.setPose(target_pose_relative)
                        program.MoveJ(target)
                        SuccessMessage += f"\nPlane {idx + 1} reachable with joint movement."

                    except Exception as e_joint:
                        # If joint movement also fails, mark the plane as unreachable
                        SuccessMessage += f"\nPlane {idx + 1} unreachable. Error: {str(e_joint)}"
                        PlaneExtra.append(plane)
                        continue

                # Record the TCP orientation and coordinates for reporting purposes
                TCPOrientations.append(format_tcp_orientation(plane, f"Plane {idx + 1}"))
                TargetPointCoordinates.append(format_target_coordinates(plane, f"Plane {idx + 1}"))

            # Finalize the program name for the outputs
            Program = program_name
            SuccessMessage += f"\nProgram '{program_name}' created successfully."
# ---------- end py3_12 ----------
pln_16 = Plane(py3_12.PlaneExtra)
panel_52 = Panel(py3_12.SuccessMessage)
deplane_6 = DeconstructPlane(Plane=pln_16)  # -> Origin, XAxis, YAxis, ZAxis
panel_53 = Panel(py3_12.Program)
amp_9 = Amplitude(Vector=deplane_6.ZAxis, Amplitude=50)
vdis_4 = VectorDisplay(Anchor=deplane_6.Origin, Vector=amp_9)

panel_54 = Panel("""1
4""")
panel_55 = Panel("""40.00
20.00""")
robot_3_4 = RemoteReceiver(robot_3)
py3_13 = Python3Script(
    RobotName=robot_3_4,
    UpdateRoboDK=Toggle(False),
    PlanesList=element6,
    SetSpeedOrder=panel_54,
    SetSpeedValue=panel_55,
    StopOrder="6")  # -> out, SuccessMessage, TargetPoses, Program, TCPOrientations, PlaneExtra; inputs PlanesList: list of Plane, SetSpeedOrder: list of Int32, SetSpeedValue: list of Double, StopOrder: list of Int32; same code as py3_12
pln_17 = Plane(py3_13.PlaneExtra)
deplane_7 = DeconstructPlane(Plane=pln_17)  # -> Origin, XAxis, YAxis, ZAxis
amp_10 = Amplitude(Vector=deplane_7.ZAxis, Amplitude=50)
vdis_5 = VectorDisplay(Anchor=deplane_7.Origin, Vector=amp_10)

panel_58 = Panel(element4_2)

item_14 = ListItem(List=element5_2, Index=Slider(5, range=0..8), Wrap=True)
py3_14 = Python3Script(
    plane=item_14,
    x_rot=Slider(-90, range=-180..180),
    y_rot=Slider(0, range=0..180),
    z_rot=Slider(90, range=0..180),
    swap_xy=False)  # -> out, a; inputs plane: Plane, swap_xy: Boolean; same code as py3_5
deplane_8 = DeconstructPlane(Plane=py3_14.a)  # -> Origin, XAxis, YAxis, ZAxis
amp_11 = Amplitude(Vector=deplane_8.ZAxis, Amplitude=Slider(50, range=-1000..1000))
move_17 = Move(Geometry=py3_14.a, Motion=expr("-x", amp_11))  # -> Geometry, Transform
merge_5 = Merge(Data1=move_17.Geometry, Data2=py3_14.a, Data3=move_17.Geometry)
item_15 = ListItem(List=pick_up_planes_b, Index=0, Wrap=True)  # -> flatten(Item)
item_16 = ListItem(List=guide_planes_b, Index=0, Wrap=True)
pln_18 = Plane(pln_9)
merge_6 = Merge(Data1=pln_18, Data2=item_15, Data3=pln_18, Data4=item_16, Data5=merge_5, Data6=item_16, Data7=pln_18)
panel_59 = Panel(merge_6)
